# Grasshopper definition ConduitRunsHeight.gh (Grasshopper 1.0.7)
# plug-ins: ShapeDiverForGrasshopper, Human

python = GhPythonScript(OPEN_MAIN_BRANCH=Button(), OPEN_HELP_IN_GITHUB=Button(), OPEN_LOCAL_HELP=Button())  # -> out, md; inputs OPEN_MAIN_BRANCH: Boolean
# ---------- python: Python ----------
import System
import webbrowser
import clr
import os

clr.AddReference("System.Net")
import System.Net

ghenv.Component.Message = "GIT Help"

REPO_URL = "https://github.com/Andrupavlov/GHDoc-temp"
RAW_URL = "https://raw.githubusercontent.com/Andrupavlov/GHDoc-temp"
SUBFOLDER_IN_REPO = "Doc"

def open_url_in_thread(url):
    def thread_func():
        webbrowser.open(url)
    t = System.Threading.Thread(System.Threading.ThreadStart(thread_func))
    t.IsBackground = True
    t.Start()

def get_gh_filename():
    doc = ghenv.Component.OnPingDocument()
    file_path = doc.FilePath
    if not file_path:
        print "File not saved"
        return None, None

    file_name = os.path.basename(file_path)
    name_without_ext = os.path.splitext(file_name)[0]
    folder = os.path.dirname(file_path)
    return name_without_ext, folder

def find_git_root(start_folder):
    current = start_folder
    while current and current != os.path.dirname(current):
        if os.path.isdir(os.path.join(current, ".git")):
            return current
        current = os.path.dirname(current)
    return None

def get_git_branch(git_root_folder):
    head_path = os.path.join(git_root_folder, ".git", "HEAD")
    if not os.path.exists(head_path):
        print ".git/HEAD does not exist"
        return None

    with open(head_path, "r") as f:
        content = f.read().strip()
        if content.startswith("ref: refs/heads/"):
            return content.replace("ref: refs/heads/", "")
        else:
            return None

def check_github_file_exists(branch, subfolder, filename_no_ext):
    raw_url = RAW_URL + "/" + branch + "/" + subfolder + "/" + filename_no_ext + ".md"
    try:
        req = System.Net.WebRequest.Create(raw_url)
        req.Method = "HEAD"
        resp = req.GetResponse()
        resp.Close()
        return True
    except System.Net.WebException as e:
        if e.Response:
            e.Response.Close()
        return False

def create_local_md_file(git_root, subfolder, filename_no_ext):
    doc_dir = os.path.join(git_root, subfolder)
    if not os.path.exists(doc_dir):
        os.makedirs(doc_dir)

    md_path = os.path.join(doc_dir, filename_no_ext + ".md")
    if os.path.exists(md_path):
        print "The file already exists locally:", md_path
        return

    with open(md_path, "w") as f:
        f.write("# " + filename_no_ext + "\n\nDocumentation for " + filename_no_ext + ".gh\n")
    print "✅ A local .md file has been created:", md_path
    print "→ Don't forget to commit and push it to GitHub."

def open_github_doc(base_repo_url, doc_subfolder="Doc"):
    file_name, file_folder = get_gh_filename()
    if not file_name or not file_folder:
        return

    git_root = find_git_root(file_folder)
    if not git_root:
        print "No .git found in directories above"
        return

    branch = get_git_branch(git_root)
    if not branch:
        return

    file_exists = check_github_file_exists(branch, doc_subfolder, file_name)
    if not file_exists:
        print "❌ Markdown file not found on GitHub. Creating locally..."
        create_local_md_file(git_root, doc_subfolder, file_name)

    github_path = base_repo_url + "/blob/" + branch + "/" + doc_subfolder + "/" + file_name + ".md"
    open_url_in_thread(github_path)
    return github_path

def open_local_md_file(doc_subfolder="Doc"):
    file_name, file_folder = get_gh_filename()
    if not file_name or not file_folder:
        return

    git_root = find_git_root(file_folder)
    if not git_root:
        print "No .git found in directories above"
        return

    doc_dir = os.path.join(git_root, doc_subfolder)
    if not os.path.exists(doc_dir):
        os.makedirs(doc_dir)

    md_path = os.path.join(doc_dir, file_name + ".md")
    if not os.path.exists(md_path):
        with open(md_path, "w") as f:
            f.write("# " + file_name + "\n\nDocumentation for " + file_name + ".gh\n")
        print "✅ A local .md file has been created.:", md_path
        print "→ Don't forget to commit it to git"

    # Open in system editor — IN A SEPARATE FLOW
    def thread_func():
        try:
            System.Diagnostics.Process.Start(md_path)
            print "📄 Local file opened:", md_path
        except Exception as e:
            print "Unable to open file:", str(e)

    t = System.Threading.Thread(System.Threading.ThreadStart(thread_func))
    t.IsBackground = True
    t.Start()

def read_local_md_file(doc_subfolder="Doc"):
    file_name, file_folder = get_gh_filename()
    if not file_name or not file_folder:
        return None

    git_root = find_git_root(file_folder)
    if not git_root:
        print "No .git found in directories above"
        return None

    doc_dir = os.path.join(git_root, doc_subfolder)
    md_path = os.path.join(doc_dir, file_name + ".md")

    if not os.path.exists(md_path):
        print "Local file does not exist:", md_path
        return None

    try:
        with open(md_path, "r") as f:
            content = f.read()
            return content
    except Exception as e:
        print "Error reading .md:", str(e)
        return None


if OPEN_MAIN_BRANCH:
    open_url_in_thread(REPO_URL)

if OPEN_HELP_IN_GITHUB:
    open_github_doc(REPO_URL, doc_subfolder=SUBFOLDER_IN_REPO)

if OPEN_LOCAL_HELP:
    open_local_md_file(SUBFOLDER_IN_REPO)

md = read_local_md_file(SUBFOLDER_IN_REPO)
# ---------- end python ----------
panel = Panel(python.md)
sddp = ShapeDiverDocumentPayload({AbsoluteTolerance=0, AngleTolerance=0, DistanceDisplayPrecision=0, GltfVersion="Gltf2", GrasshopperVersion="1.0.0007", InputGroups="{}", OutputGroups="{}", RelativeTolerance=0, RhinoVersion="7.37.24107.15001", UnitSystem=0, VersionCreated="1.18.1.0", VersionSaved="1.18.1.0"})

# ---- group: Structure
_1 = Data(simplify(Tree({0}: [{Plane=PlaneXY(-559.0005264, 3317.662068, -142.8), X=Domain(-102.5, 102.5), Y=Domain(-2.5, 2.5), Z=Domain(-6.85, 6.85)}, {Plane=PlaneXY(-559.0005264, 3161.662068, -142.8), X=Domain(-102.5, 102.5), Y=Domain(-2.5, 2.5), Z=Domain(-6.85, 6.85)}, {Plane=Plane(origin=(3852.997209, 1096.537068, -125), x=(-1, 0, 0), y=(0, -1, 0)), X=Domain(-4, 4), Y=Domain(-4, 4), Z=Domain(1, 360)}, {Plane=Plane(origin=(3852.997209, 894.5370684, -125), x=(-1, 0, 0), y=(0, -1, 0)), X=Domain(-4, 4), Y=Domain(-4, 4), Z=Domain(1, 360)}, {Plane=Plane(origin=(3949.997209, 1096.537068, -125), x=(-1, 0, 0), y=(0, -1, 0)), X=Domain(-4, 4), Y=Domain(-4, 4), Z=Domain(1, 360)}, {Plane=Plane(origin=(3948.997209, 894.5370684, -125), x=(-1, 0, 0), y=(0, -1, 0)), X=Domain(-4, 4), Y=Domain(-4, 4), Z=Domain(1, 523.5)}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], {1}: [], {2}: [], {3}: [{Plane=PlaneXY(-566.0649245, 3235.334956, -98.35), X=Domain(-95.5, 95.5), Y=Domain(-2.5, 2.5), Z=Domain(-6.85, 6.85)}, {Plane=PlaneXY(2497.932811, 715.3349562, -1648), X=Domain(-8, 8), Y=Domain(-8, 8), Z=Domain(1662.25, 1685.5)}, {Plane=PlaneXY(2333.932811, 715.3349562, -1648), X=Domain(-2, 2), Y=Domain(-4, 4), Z=Domain(1686.25, 1883)}, {Plane=PlaneXY(1509.932811, 715.3349562, -1648), X=Domain(-2, 2), Y=Domain(-4, 4), Z=Domain(1686.25, 1883)}, {Plane=PlaneXY(317.9328112, 715.3349562, -1648), X=Domain(-2, 2), Y=Domain(-4, 4), Z=Domain(1686.25, 1883)}, {Plane=PlaneXY(197.9311692, -480.6650438, -1648), X=Domain(-15, 15), Y=Domain(-15, 15), Z=Domain(1634.25, 1681.5)}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])))

# ----
_2 = Data(simplify(Tree({0;-16}: [], {0;-12}: [{Plane=PlaneXY(-586.2157573, -446.5, 0), X=Domain(-3, 3), Y=Domain(-3, 3), Z=Domain(-152, 492)}, {Plane=Plane(origin=(781.7842427, -462.5, 0), x=(0, -1, 0), y=(1, 0, 0)), X=Domain(-3, 3), Y=Domain(-3, 3), Z=Domain(-152, 160)}, {Plane=PlaneXY(-798.2157573, -70.5, 0), X=Domain(-3, 3), Y=Domain(-3, 3), Z=Domain(-152, 492)}, {Plane=PlaneXY(804.7842427, 349.5, 0), X=Domain(-3, 3), Y=Domain(-3, 3), Z=Domain(-152, 492)}, {Plane=Plane(origin=(-985.9146128, 234.483846, 0), x=(0.8191520443, 0.5735764364, 0), y=(-0.5735764364, 0.8191520443, 0)), X=Domain(-3, 3), Y=Domain(-3, 3), Z=Domain(-152, 492)}, {Plane=Plane(origin=(-882.0972778, 86.21732601, 0), x=(0.8191520443, 0.5735764364, 0), y=(-0.5735764364, 0.8191520443, 0)), X=Domain(-3, 3), Y=Domain(-3, 3), Z=Domain(-152, 492)}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], {0;-5}: [], {0;0}: [], {0;9}: [], {0;13}: [{Plane=Plane(origin=(442.7842427, -478.5, 0), x=(0, -1, 0), y=(1, 0, 0)), X=Domain(-3, 3), Y=Domain(-3, 3), Z=Domain(160, 492)}, {Plane=Plane(origin=(88.78424271, -478.5, 0), x=(0, -1, 0), y=(1, 0, 0)), X=Domain(-3, 3), Y=Domain(-3, 3), Z=Domain(160, 492)}, {Plane=PlaneXY(-42.21575729, -478.5, 0), X=Domain(-3, 3), Y=Domain(-3, 3), Z=Domain(160, 492)}, {Plane=Plane(origin=(781.7842427, -478.5, 0), x=(0, -1, 0), y=(1, 0, 0)), X=Domain(-3, 3), Y=Domain(-3, 3), Z=Domain(160, 492)}]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)))
_3 = Data(simplify(Tree({0;0}: [], {0;8}: [], {0;10}: [], {0;17}: [], {0;19}: [], {0;20}: []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)))

list = ValueList({"0", "1", "2"}, selected="2")
filter = StreamFilter(Gate=list, Stream0=_1, Stream1=_2, Stream2=_3)  # -> flatten(Stream)
clean = CleanTree(RemoveNulls=True, RemoveInvalid=True, RemoveEmpty=False, Tree=filter)
previewmat = CustomPreviewMaterials(Geometry=clean, DiffuseColor=ColourSwatch(SwatchColor=RGB(171, 171, 171)), Transparency="0.85")
python_2 = GhPythonScript(boxes=clean)  # -> out, structure_objects; inputs boxes: list of Box
# ---------- python_2: Python ----------
import Rhino.Geometry as rg
import Grasshopper as gh

ghenv.Component.Message = "Structure objects"

class Structure:
    def __init__(self, geometry):
        self.geometry = geometry
        self.corners = geometry.GetCorners()
        self.center = self._get_center()
        self.longest_edge = self._get_longest_edge()
        self.normalized_vector = self._get_normalized_vector()
        self.centered_longest_edge = self._get_centered_longest_edge()
        self.volume = geometry.Volume
        self.dimensions = self._get_dimensions()
        self.surface_area = self._get_surface_area()
    
    def _get_longest_edge(self):
        """Знаходить найдовше ребро коробки"""
        # All edges (12) are specified by pairs of indices from the array of angles
        edges_indices = [
            (0,1), (1,2), (2,3), (3,0),  # lower edge
            (4,5), (5,6), (6,7), (7,4),  # topedge
            (0,4), (1,5), (2,6), (3,7)   # vertical ribs
        ]
        
        max_length = 0
        longest_edge = None

        for i1, i2 in edges_indices: # vertical ribs
            pt1 = self.corners[i1]
            pt2 = self.corners[i2]
            length = pt1.DistanceTo(pt2)
            if length > max_length:
                max_length = length
                longest_edge = rg.Line(pt1, pt2)
        
        return longest_edge
    
    def _get_normalized_vector(self):
        """Calculates the normalized vector along the longest side"""
        if self.longest_edge is None:
            return None
        
        # Get the direction of the longest edge
        direction = self.longest_edge.Direction
        # Normalize the vector (length = 1)
        normalized_vector = direction / direction.Length
        
        return normalized_vector
    
    def _get_centered_longest_edge(self):
        """Takes the longest edge, finds its central point and moves it to the center of the object"""
        if self.longest_edge is None:
            return None
        
        # Find the central point of the longest edge
        edge_center = self.longest_edge.PointAt(0.5)
        
        # Calculate the translation vector from the center of the edge to the center of the object
        translation_vector = self.center - edge_center
        
        # Move the edge so that its center coincides with the center of the object
        start_point = self.longest_edge.From + translation_vector
        end_point = self.longest_edge.To + translation_vector
        
        # Create a new edge with moved points
        centered_edge = rg.Line(start_point, end_point)
        
        return centered_edge
    
    def _get_center(self):
        """Calculates the center of the box"""
        # Center = arithmetic mean of all angles
        sum_x = sum(corner.X for corner in self.corners)
        sum_y = sum(corner.Y for corner in self.corners)
        sum_z = sum(corner.Z for corner in self.corners)
        
        return rg.Point3d(sum_x / 8, sum_y / 8, sum_z / 8)
    
    def _get_dimensions(self):
        """Calculates the dimensions of the box (length, width, height)"""
        # Calculate the dimensions through the distances between angles
        # Assume the standard order of angles of the box
        length = self.corners[0].DistanceTo(self.corners[1])  # edge by X
        width = self.corners[0].DistanceTo(self.corners[3])   # edge by Y
        height = self.corners[0].DistanceTo(self.corners[4])  # edge by Z
        
        return rg.Vector3d(length, width, height)
    
    def _get_surface_area(self):
        """Calculates the surface area of the box"""
        # Surface area = 2 * (length*width + length*height + width*height)
        length = self.dimensions.X
        width = self.dimensions.Y
        height = self.dimensions.Z
        
        return 2 * (length * width + length * height + width * height)
    
    def get_all_edges(self):
        """Returns all edges of the box with their lengths"""
        edges_indices = [
            (0,1), (1,2), (2,3), (3,0),  # lower edge
            (4,5), (5,6), (6,7), (7,4),  # top edge
            (0,4), (1,5), (2,6), (3,7)   # vertical ribs
        ]
        
        edges = []
        for i1, i2 in edges_indices:
            pt1 = self.corners[i1]
            pt2 = self.corners[i2]
            edge = rg.Line(pt1, pt2)
            length = pt1.DistanceTo(pt2)
            edges.append({
                'line': edge,
                'length': length,
                'indices': (i1, i2)
            })
        
        return edges

# Create a list of Structure objects from the input boxes
structure_objects = [Structure(box) for box in boxes]
# ---------- end python_2 ----------
panel_2 = Panel(python_2.out)
number_slider = Slider(30, range=0..100)
python_3 = GhPythonScript(
    structure_objects=python_2.structure_objects,
    Z_TOLERANCE=Slider(0.187, range=0..1),
    DBSCAN_EPS=Slider(30, range=0..100),
    DBSCAN_MIN_PTS=Slider(3, range=0..10),
    GRID_SIZE=Slider(300, range=0..1000),
    MAX_HEIGHT_DIFFERENCE_PERCENT=number_slider)  # -> out, out_structure_clusters_box, out_structure_clusters_line; inputs structure_objects: list
# ---------- python_3: Python ----------
import Rhino.Geometry as rg
import Grasshopper as gh
from collections import deque, defaultdict
import json

ghenv.Component.Message = "Clustering and filtering"

def filter_structures_by_z_alignment(structure_objects, tolerance):
    """
    Filters structures based on the dot product between normalized_vector and vector Z.
    
    Args:
        structure_objects: list of objects Structure
        tolerance: allowable deviation from zero (default 0.1)
    
    Returns:
        list of Structure objects, which have dot product close to zero
    """
    z_vector = rg.Vector3d(0, 0, 1)  # Z vector
    filtered_objects = []
    
    for structure in structure_objects:
        if structure.normalized_vector is not None:
            # Calculate the dot product between normalized_vector and vector Z
            dot_product = abs(structure.normalized_vector * z_vector)
            
            # If the dot product is close to zero (perpendicular vectors)
            if dot_product <= tolerance:
                filtered_objects.append(structure)
    
    return filtered_objects

def create_spatial_grid(structure_objects, grid_size):
    """
    Divides structures into a spatial grid for fast search for neighbors.
    
    Args:
        structure_objects: list of objects Structure
        grid_size: size of the grid cell
    
    Returns:
        dict: keys - coordinates of the grid cells, values - lists of indices of structures
        tuple: (min_bounds, max_bounds) boundaries of the space of structures
    """
    if not structure_objects:
        return {}, (rg.Point3d.Origin, rg.Point3d.Origin)
    
    # Find the boundaries of the entire space
    min_x = min_y = min_z = float('inf')
    max_x = max_y = max_z = float('-inf')
    
    for structure in structure_objects:
        if structure.centered_longest_edge is not None:
            # Use the center of centered_longest_edge for positioning
            center = structure.centered_longest_edge.PointAt(0.5)
            min_x = min(min_x, center.X)
            max_x = max(max_x, center.X)
            min_y = min(min_y, center.Y)
            max_y = max(max_y, center.Y)
            min_z = min(min_z, center.Z)
            max_z = max(max_z, center.Z)
    
    min_bounds = rg.Point3d(min_x, min_y, min_z)
    max_bounds = rg.Point3d(max_x, max_y, max_z)
    
    # Create a grid
    grid = defaultdict(list)
    
    for i, structure in enumerate(structure_objects):
        if structure.centered_longest_edge is not None:
            center = structure.centered_longest_edge.PointAt(0.5)
            
            # Calculate the indices of the grid cell
            grid_x = int((center.X - min_x) / grid_size)
            grid_y = int((center.Y - min_y) / grid_size)
            grid_z = int((center.Z - min_z) / grid_size)
            
            grid[(grid_x, grid_y, grid_z)].append(i)
    
    return dict(grid), (min_bounds, max_bounds)

def get_neighboring_cells(grid_pos, radius=1):
    """
    Returns the coordinates of neighboring grid cells in the radius.
    
    Args:
        grid_pos: (x, y, z) position of the current grid cell
        radius: radius of the search for neighboring cells
    
    Returns:
        list: list of coordinates of neighboring cells
    """
    gx, gy, gz = grid_pos
    neighbors = []
    
    for dx in range(-radius, radius + 1):
        for dy in range(-radius, radius + 1):
            for dz in range(-radius, radius + 1):
                neighbors.append((gx + dx, gy + dy, gz + dz))
    
    return neighbors

def get_candidate_neighbors_from_grid(structure_index, structure_objects, spatial_grid, grid_size, bounds):
    """
    Gets a list of candidate neighbors for a given structure from the spatial grid.
    
    Args:
        structure_index: index of the current structure
        structure_objects: list of all structures
        spatial_grid: dictionary of the spatial grid
        grid_size: size of the grid cell
        bounds: (min_bounds, max_bounds) boundaries of the space
    
    Returns:
        list: list of indices of candidate structures
    """
    structure = structure_objects[structure_index]
    if structure.centered_longest_edge is None:
        return []
    
    min_bounds, max_bounds = bounds
    center = structure.centered_longest_edge.PointAt(0.5)
    
    # Find the position of the current structure in the grid
    grid_x = int((center.X - min_bounds.X) / grid_size)
    grid_y = int((center.Y - min_bounds.Y) / grid_size)
    grid_z = int((center.Z - min_bounds.Z) / grid_size)
    
    # Get neighboring cells (including the current one)
    neighboring_cells = get_neighboring_cells((grid_x, grid_y, grid_z), radius=1)
    
    candidates = []
    for cell_pos in neighboring_cells:
        if cell_pos in spatial_grid:
            candidates.extend(spatial_grid[cell_pos])
    
    # Exclude the current structure from the candidates
    candidates = [idx for idx in candidates if idx != structure_index]
    
    return candidates

def dbscan_structures_by_centered_edges(structure_objects, eps, min_pts, grid_size):
    """
    Clustering of Structure objects in 3D space using the DBSCAN principle with optimization through the spatial grid,
    where the distance between structures is the minimum geometric distance between their centered_longest_edge.

    Args:
        structure_objects: list of objects Structure
        eps: radius of the search for neighbors
        min_pts: minimum number of neighbors to consider a point a core
        grid_size: size of the grid cell of the spatial grid (if None, calculated automatically)
    
    Returns:
        list of lists of objects Structure, grouped by clusters
    """
    if not structure_objects:
        return []
    
    # Create a spatial grid
    spatial_grid, bounds = create_spatial_grid(structure_objects, grid_size)
    
    visited = [False] * len(structure_objects)
    labels = [-1] * len(structure_objects)  # -1 means noise
    cluster_id = 0

    def structure_distance(structA, structB):
        """
        Calculates the minimum distance between the centered_longest_edge of two structures
        """
        if structA.centered_longest_edge is None or structB.centered_longest_edge is None:
            return float('inf')
            
        lineA = structA.centered_longest_edge
        lineB = structB.centered_longest_edge
        
        # Calculate the minimum distance between two lines
        ptsA = [lineA.From, lineA.To, lineA.PointAt(0.5)]
        ptsB = [lineB.From, lineB.To, lineB.PointAt(0.5)]
        dists = []

        for pt in ptsA:
            dists.append(lineB.DistanceTo(pt, True))
        for pt in ptsB:
            dists.append(lineA.DistanceTo(pt, True))

        return min(dists)

    def region_query(i):
        """
        Finds all neighbors for a structure with index i, using the spatial grid
        """
        # Get candidates from the spatial grid instead of checking all objects
        candidate_indices = get_candidate_neighbors_from_grid(i, structure_objects, spatial_grid, grid_size, bounds)
        
        neighbors = []
        for j in candidate_indices:
            dist = structure_distance(structure_objects[i], structure_objects[j])
            if dist <= eps:
                neighbors.append(j)
        
        return neighbors

    # Main DBSCAN algorithm
    for i in range(len(structure_objects)):
        if visited[i]:
            continue
        visited[i] = True
        neighbors = region_query(i)

        if len(neighbors) < min_pts:
            labels[i] = -1  # noise
        else:
            # creating a new cluster
            labels[i] = cluster_id
            queue = deque(neighbors)
            while queue:
                j = queue.popleft()
                if not visited[j]:
                    visited[j] = True
                    j_neighbors = region_query(j)
                    if len(j_neighbors) >= min_pts:
                        queue.extend(j_neighbors)
                if labels[j] == -1:
                    labels[j] = cluster_id
                elif labels[j] == -2:
                    labels[j] = cluster_id
            cluster_id += 1

    # Building the result
    clusters = defaultdict(list)
    for i, label in enumerate(labels):
        if label >= 0:
            clusters[label].append(structure_objects[i])

    return list(clusters.values())

def filter_clusters_by_properties(structure_clusters, filter_criteria):
    """
    Filters clusters based on the properties of Structure objects.
    
    Args:
        structure_clusters: list of lists of objects Structure (result of DBSCAN)
        filter_criteria: dictionary with filtering criteria:
            - 'volume': (min, max) - volume range
            - 'surface_area': (min, max) - surface area range
            - 'dimensions': (min_length, max_length, min_width, max_width, min_height, max_height)
            - 'longest_edge_length': (min, max) - range of the length of the longest edge
            - 'min_cluster_size': minimum number of objects in the cluster
            - 'max_cluster_size': maximum number of objects in the cluster
    
    Returns:
        list of lists of objects Structure - filtered clusters
    """
    filtered_clusters = []
    
    for cluster in structure_clusters:
        if not cluster:  # Skip empty clusters
            continue
            
        # Check the size of the cluster
        cluster_size = len(cluster)
        if 'min_cluster_size' in filter_criteria and cluster_size < filter_criteria['min_cluster_size']:
            continue
        if 'max_cluster_size' in filter_criteria and cluster_size > filter_criteria['max_cluster_size']:
            continue
        
        # Check the properties of objects in the cluster
        cluster_passes = True
        
        for structure in cluster:
            # Check the volume
            if 'volume' in filter_criteria:
                min_vol, max_vol = filter_criteria['volume']
                if not (min_vol <= structure.volume <= max_vol):
                    cluster_passes = False
                    break
            
            # Check the surface area
            if 'surface_area' in filter_criteria:
                min_area, max_area = filter_criteria['surface_area']
                if not (min_area <= structure.surface_area <= max_area):
                    cluster_passes = False
                    break
            
            # Check the dimensions
            if 'dimensions' in filter_criteria:
                min_len, max_len, min_wid, max_wid, min_hgt, max_hgt = filter_criteria['dimensions']
                if not (min_len <= structure.dimensions.X <= max_len and
                       min_wid <= structure.dimensions.Y <= max_wid and
                       min_hgt <= structure.dimensions.Z <= max_hgt):
                    cluster_passes = False
                    break
            
            # Check the length of the longest edge
            if 'longest_edge_length' in filter_criteria:
                min_edge, max_edge = filter_criteria['longest_edge_length']
                if structure.longest_edge is not None:
                    edge_length = structure.longest_edge.Length
                    if not (min_edge <= edge_length <= max_edge):
                        cluster_passes = False
                        break
        
        if cluster_passes:
            filtered_clusters.append(cluster)
    
    return filtered_clusters

def get_cluster_statistics(structure_clusters):
    """
    Calculates the statistics of clusters for analysis and returns in JSON format.
    
    Args:
        structure_clusters: list of lists of objects Structure
    
    Returns:
        str: JSON string with statistics for each cluster
    """
    cluster_stats = []
    
    for i, cluster in enumerate(structure_clusters):
        if not cluster:
            continue
            
        # Basic statistics
        cluster_size = len(cluster)
        volumes = [s.volume for s in cluster]
        surface_areas = [s.surface_area for s in cluster]
        
        # Sizes
        lengths = [s.dimensions.X for s in cluster]
        widths = [s.dimensions.Y for s in cluster]
        heights = [s.dimensions.Z for s in cluster]
        
        # Lengths of the longest edges
        edge_lengths = []
        for s in cluster:
            if s.longest_edge is not None:
                edge_lengths.append(s.longest_edge.Length)
        
        stats = {
            'cluster_id': i,
            'size': cluster_size,
            'volume': {
                'min': round(min(volumes), 3),
                'max': round(max(volumes), 3),
                'avg': round(sum(volumes) / len(volumes), 3)
            },
            'surface_area': {
                'min': round(min(surface_areas), 3),
                'max': round(max(surface_areas), 3),
                'avg': round(sum(surface_areas) / len(surface_areas), 3)
            },
            'dimensions': {
                'length': {
                    'min': round(min(lengths), 3),
                    'max': round(max(lengths), 3),
                    'avg': round(sum(lengths) / len(lengths), 3)
                },
                'width': {
                    'min': round(min(widths), 3),
                    'max': round(max(widths), 3),
                    'avg': round(sum(widths) / len(widths), 3)
                },
                'height': {
                    'min': round(min(heights), 3),
                    'max': round(max(heights), 3),
                    'avg': round(sum(heights) / len(heights), 3)
                }
            }
        }
        
        if edge_lengths:
            stats['longest_edge_length'] = {
                'min': round(min(edge_lengths), 3),
                'max': round(max(edge_lengths), 3),
                'avg': round(sum(edge_lengths) / len(edge_lengths), 3)
            }
        
        cluster_stats.append(stats)
    
    # Return the JSON string with indentations for readability
    return json.dumps(cluster_stats, indent=2, ensure_ascii=False)

def filter_clusters_by_z_height(structure_clusters, max_height_difference_percent):
    """
    Filters objects in clusters by the Z coordinate.
    Removes objects that differ significantly in the minimum Z coordinate from the highest point of the cluster.
    
    Args:
        structure_clusters: list of lists of objects Structure
        max_height_difference_percent: maximum difference in percent (e.g., 20 for 20%)
    
    Returns:
        list of lists of objects Structure with filtered objects
    """
    filtered_clusters = []
    
    for cluster in structure_clusters:
        if not cluster:
            continue
            
        # 1. Find the highest Z coordinate of the cluster
        max_z_in_cluster = float('-inf')
        for structure in cluster:
            if structure.corners:
                for corner in structure.corners:
                    if corner.Z > max_z_in_cluster:
                        max_z_in_cluster = corner.Z
        
        if max_z_in_cluster == float('-inf'):
            continue
        
        # 2. Filter objects by the minimum Z coordinate
        filtered_objects = []
        
        for structure in cluster:
            if structure.corners:
                # Find the minimum Z coordinate for this object
                min_z_object = min(corner.Z for corner in structure.corners)
                
                # Calculate the height difference
                height_difference = max_z_in_cluster - min_z_object
                
                # Calculate the percentage difference relative to the highest point
                if max_z_in_cluster != 0:
                    height_difference_percent = (height_difference / abs(max_z_in_cluster)) * 100
                else:
                    height_difference_percent = 0
                
                # If the difference is less than the allowable percentage - keep the object
                if height_difference_percent <= max_height_difference_percent:
                    filtered_objects.append(structure)
        
        # Add the cluster only if there are objects left
        if filtered_objects:
            filtered_clusters.append(filtered_objects)
    
    return filtered_clusters

def create_structure_clusters_tree(structure_clusters):
    """
    Creates a Grasshopper tree with clusters of Structure objects.
    
    Args:
        structure_clusters: list of lists of objects Structure (result of DBSCAN)
    
    Returns:
        gh.DataTree[object] - Grasshopper tree with geometry of objects by clusters
    """
    gh_tree = gh.DataTree[object]()
    
    for i, cluster in enumerate(structure_clusters):
        # Create a path for the branch of the cluster
        path = gh.Kernel.Data.GH_Path(i)
        
        # Add the geometry of objects of the cluster to the branch
        for structure_obj in cluster:
            gh_tree.Add(structure_obj.geometry, path)
    
    return gh_tree

def create_centered_edges_tree(structure_clusters):
    """
    Creates a Grasshopper tree with centered_longest_edge of clusters of Structure objects.
    
    Args:
        structure_clusters: list of lists of objects Structure (result of DBSCAN)
    
    Returns:
        gh.DataTree[object] - Grasshopper tree with centered_longest_edge by clusters
    """
    gh_tree = gh.DataTree[object]()
    
    for i, cluster in enumerate(structure_clusters):
        # Create a path for the branch of the cluster
        path = gh.Kernel.Data.GH_Path(i)
        
        # Add the centered_longest_edge of objects of the cluster to the branch
        for structure_obj in cluster:
            if structure_obj.centered_longest_edge is not None:
                gh_tree.Add(structure_obj.centered_longest_edge, path)
    
    return gh_tree

# Filter objects with perpendicular vectors to the Z vector
filtered_structures = filter_structures_by_z_alignment(structure_objects, Z_TOLERANCE)
# a = [structure_obj.geometry for structure_obj in filtered_structures]

# Clustering of filtered structures using DBSCAN
structure_clusters = dbscan_structures_by_centered_edges(filtered_structures, DBSCAN_EPS, DBSCAN_MIN_PTS, GRID_SIZE)

# Getting statistics of clusters for analysis
# cluster_statistics = get_cluster_statistics(structure_clusters)
# print(cluster_statistics)

# Filtering clusters by properties
filter_criteria = {
    # 'volume': (100, 90000000000),  # volume from 100 to 10000
    'surface_area': (110, 90000000000),  # surface area from 50 to 500
    # 'dimensions': (5, 20, 5, 20, 5, 20),  # dimensions: length 5-20, width 5-20, height 5-20
    # 'longest_edge_length': (10, 30),  # length of the longest edge 10-30
    'min_cluster_size': 20,  # minimum 3 objects in the cluster
    # 'max_cluster_size': 50  # maximum 50 objects in the cluster
}
structure_clusters = filter_clusters_by_properties(structure_clusters, filter_criteria)

# Filtering clusters by the Z coordinate
structure_clusters = filter_clusters_by_z_height(structure_clusters, MAX_HEIGHT_DIFFERENCE_PERCENT)

# Creating a tree with the geometry of clusters (filtered)
out_structure_clusters_box = create_structure_clusters_tree(structure_clusters)

# Creating a tree with the centered_longest_edge of clusters (filtered)
out_structure_clusters_line = create_centered_edges_tree(structure_clusters)
# ---------- end python_3 ----------

bbox = BoundingBox(Content=python_3.out_structure_clusters_box, Plane=PlaneXY(0, 0, 0), UnionBox=True)  # -> Box, Box_2
box_corners = BoxCorners(Box=bbox.Box)  # -> CornerA, CornerB, CornerC, CornerD, CornerE, CornerF, CornerG, CornerH
pt = Point(box_corners.CornerA)
pdecon = Deconstruct(Point=pt)  # -> XComponent, YComponent, ZComponent
tag = TextTag(Location=pt, Text=pdecon.ZComponent, Colour=ColourSwatch(SwatchColor=RGB(0, 0, 0)))
h = Panel(pdecon.ZComponent)
