# Grasshopper definition Suspension.gh (Grasshopper 1.0.7)
# plug-ins: Human

python = GhPythonScript()  # -> path
# ---------- python: Python ----------
import os

def find_git_help_script():
    # Get the path to the GH file
    doc = ghenv.Component.OnPingDocument()
    file_path = doc.FilePath
    if not file_path:
        print "File not saved"
        return None

    current_dir = os.path.dirname(file_path)  # Current directory of the .gh file
    parent_dir = os.path.dirname(current_dir)  # One level higher

    py_dir = os.path.join(parent_dir, "Py")  # Expected Py folder
    target_file = os.path.join(py_dir, "git_help.py")

    if os.path.exists(target_file):
        print "✅ Found git_help.py:", target_file
        return target_file
    else:
        print "❌ The file git_help.py was not found in:", py_dir
        return None

path = find_git_help_script()
# ---------- end python ----------
file = ReadFile(File=python, PerLineParse=False)
python_2 = GhPythonScript(Code=file, OPEN_MAIN_BRANCH=Button(), OPEN_HELP_IN_GITHUB=Button(), OPEN_LOCAL_HELP=Button())  # -> Out, Md
panel = Panel(python_2.Md)

list = ValueList({"0", "1", "2", "3"}, selected="0")
crv = Curve(Tree({0;0}: [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], {0;1}: [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], {1;0}: [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], {1;1}: [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], {2;0}: [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], {2;1}: [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], {3;0}: [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], {3;1}: [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]))
crv_2 = Curve(Tree({0}: [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], {1}: [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]))
data = Data(Tree({0;0}: [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], {0;1}: [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], {1;0}: [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], {1;1}: [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], {2;0}: [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], {3;0}: [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]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))
crv_3 = Curve(Tree({0;0}: [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], {0;1}: [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], {1;0}: [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], {1;1}: [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], {2;0}: [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], {2;1}: [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], {2;2}: [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], {3;0}: [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]))
stream_filter = StreamFilter(Gate=list, Stream0=data, Stream1=crv, Stream2=crv_3, Stream3=crv_2)

# ---- group: renumber paths
ghpython_script = GhPythonScript(Data=stream_filter)  # -> out, Renumbered_Data; inputs Data: tree
# ---------- ghpython_script: Python ----------
import Grasshopper as gh
import System


Renumbered_Data = gh.DataTree[System.Object]()

for i in range(Data.BranchCount):
    newPath = gh.Kernel.Data.GH_Path(i)
    currBranch = Data.Branch(i)
    Renumbered_Data.AddRange(currBranch, newPath)
# ---------- end ghpython_script ----------

# ----
ghpython_script_2 = GhPythonScript()  # -> out, LineUtils
# ---------- ghpython_script_2: Python ----------
import Rhino.Geometry as rg
import math
import copy
import inspect
import itertools
import time
import System
import re
import zipfile
import xml.etree.ElementTree as ET

ghenv.Component.Message = "v0.39 LineUtils library"

GLOBAL_TOL = 0.01 #need to fine tune, maybe 0.001 is better

class LineUtils(object):
    class Orientation(object):
        """
        Simple enumeration for line orientation.
        """
        VERTICAL = "vertical"
        HORIZONTAL = "horizontal"
        NONORTH = "nonorth"
    
    #currently here, need to think on where to put this style functions
    #box from rectangle, for example for line box intersection
    @staticmethod
    def rectangle_to_box(rect, thickness=10.0):
        """
        Creates a Box from a Rectangle3d by extruding it along its plane normal
        to the specified thickness.
        """
        plane = rect.Plane
        x_int = rect.X
        y_int = rect.Y
        z_int = rg.Interval(-thickness/2.0, thickness/2.0)
        return rg.Box(plane, x_int, y_int, z_int)
    
    @staticmethod
    def offset_rectangle(rect, offset, tol = GLOBAL_TOL):
        """
        Returns a new Rectangle3d expanded by the given offset on X and Y,
        enforcing a minimum size based on tolerance.
        """
        x, y = rect.X, rect.Y
        xmin, xmax = x.Min - offset, x.Max + offset
        ymin, ymax = y.Min - offset, y.Max + offset
        if xmax - xmin < tol:
            m = (xmin + xmax) * 0.5
            xmin, xmax = m - tol/2, m + tol/2
        if ymax - ymin < tol:
            m = (ymin + ymax) * 0.5
            ymin, ymax = m - tol/2, m + tol/2
        return rg.Rectangle3d(rect.Plane, rg.Interval(xmin, xmax), rg.Interval(ymin, ymax))

    @staticmethod
    def rebuild_rectangle(rect):
        """
        Rebuilds a Rectangle3d so its extents align to world X/Y axes,
        preserving its original elevation.
        """
        # get world‐space corners
        corners = [rect.Corner(i) for i in range(4)]
        xs = [pt.X for pt in corners]
        ys = [pt.Y for pt in corners]
        xmin, xmax = min(xs), max(xs)
        ymin, ymax = min(ys), max(ys)
        # build a world‐XY plane at the original Z height
        z      = rect.Plane.Origin.Z
        origin = rg.Point3d(xmin, ymin, z)
        plane  = rg.Plane(origin, rg.Vector3d.XAxis, rg.Vector3d.YAxis)
        # width along world X, height along world Y
        w = xmax - xmin
        h = ymax - ymin
        return rg.Rectangle3d(plane, w, h)

    @staticmethod
    def rectangle_axis(rect):
        """
        Returns the long axis of the rectangle as an rg.Line from midpoint to midpoint.
        """
        # get the four corners
        corners = [rect.Corner(i) for i in range(4)]
        # compute edge lengths
        lengths = [corners[i].DistanceTo(corners[(i+1)%4]) for i in range(4)]
        # find the longest edge index
        idx = lengths.index(max(lengths))
        # choose opposite midpoints based on edge orientation
        if idx in (0, 2):
            p1 = (corners[0] + corners[3]) / 2.0
            p2 = (corners[1] + corners[2]) / 2.0
        else:
            p1 = (corners[0] + corners[1]) / 2.0
            p2 = (corners[2] + corners[3]) / 2.0
        return rg.Line(p1, p2)

    @staticmethod
    def get_bounds_for_line(line, rect, axis):
        """
        Calculates a line’s projection interval on a rectangle along an axis if
        they overlap, returning that interval or None.
        """
        origin = rect.Plane.Origin
        if axis == 'y':
            rmin = origin.Y
            rmax = origin.Y + rect.Height
            lxmin = min(line.From.X, line.To.X)
            lxmax = max(line.From.X, line.To.X)
            rxmin = origin.X
            rxmax = origin.X + rect.Width
            if lxmax < rxmin - GLOBAL_TOL or lxmin > rxmax + GLOBAL_TOL:
                return None
        else:  # axis == 'x'
            rmin = origin.X
            rmax = origin.X + rect.Width
            lymin = min(line.From.Y, line.To.Y)
            lymax = max(line.From.Y, line.To.Y)
            rymin = origin.Y
            rymax = origin.Y + rect.Height
            if lymax < rymin - GLOBAL_TOL or lymin > rymax + GLOBAL_TOL:
                return None
        return (rmin, rmax)

    @staticmethod
    def get_rectangle_bounds(rect):
        """
        Calculates world-aligned X and Y bounds of a Rectangle3d,
        returning [[xmin, xmax], [ymin, ymax]].
        """
        bbox = rect.BoundingBox
        return [[bbox.Min.X, bbox.Max.X], [bbox.Min.Y, bbox.Max.Y]]

    @staticmethod
    def get_union_interval_containing(c, intervals):
        """
        Merges sorted intervals and returns the one containing a coordinate within
        tolerance, or None if no interval applies.
        """
        merged = LineUtils.merge_intervals(intervals)
        for (u_min, u_max) in merged:
            if c > u_min + GLOBAL_TOL and c < u_max - GLOBAL_TOL:
                return (u_min, u_max)
        return None

    @staticmethod
    def rects_collide(rect1, rect2):
        """
        Returns True if two Rectangle3d objects overlap by:
         - BoundingBox test  
         - Any corner of one lies Inside/Coincident with the other  
         - Any of their edges intersect
        """
        checker = (rg.PointContainment.Inside,
                   rg.PointContainment.Coincident)

        # Fast reject via AABB overlap on X/Y
        bb1 = rect1.BoundingBox
        bb2 = rect2.BoundingBox
        # no overlap if one box is entirely left/right or above/below the other
        if (bb1.Max.X < bb2.Min.X or bb1.Min.X > bb2.Max.X
         or bb1.Max.Y < bb2.Min.Y or bb1.Min.Y > bb2.Max.Y):
            return False

        #Corner containment
        for i in range(4):
            if rect1.Contains(rect2.Corner(i)) in checker:
                return True
            if rect2.Contains(rect1.Corner(i)) in checker:
                return True

        #Edge intersections: convert to closed curves and test
        crv1 = rect1.ToNurbsCurve()
        crv2 = rect2.ToNurbsCurve()
        events = rg.Intersect.Intersection.CurveCurve(
            crv1, crv2, GLOBAL_TOL, GLOBAL_TOL
        )
        if events and len(events) > 0:
            return True

        return False

    @staticmethod
    def line_outside_rectangles(line, rectangles, thickness=10.0, tol=GLOBAL_TOL):
        """
        Returns a list of Line segments representing those portions of the finite
        line segment that do NOT lie within any of the given Rectangle3d objects.
        """
        # Parametric domain of the finite line
        seg_dom = rg.Interval(0.0, 1.0)

        # 1) Collect all hit‐intervals where the line enters/exits each rectangle (as a thin box)
        intervals = []
        for rect in rectangles:
            box = LineUtils.rectangle_to_box(rect, thickness)
            hit, iv = rg.Intersect.Intersection.LineBox(line, box, tol)
            if not hit:
                continue
            t0, t1 = iv.Min, iv.Max
            lo = max(seg_dom.Min, min(t0, t1))
            hi = min(seg_dom.Max, max(t0, t1))
            if hi > lo + tol:
                intervals.append((lo, hi))

        # 2) Merge overlapping or touching intervals
        merged = LineUtils.merge_intervals(intervals)

        # 3) Compute complement intervals in [0,1]
        outside = []
        current = seg_dom.Min
        for a, b in merged:
            if a > current + tol:
                outside.append((current, a))
            current = max(current, b)
        if seg_dom.Max > current + tol:
            outside.append((current, seg_dom.Max))

        # 4) Build and return the actual line segments
        segments = []
        for t0, t1 in outside:
            pt0 = line.PointAt(t0)
            pt1 = line.PointAt(t1)
            segments.append(rg.Line(pt0, pt1))
        return segments

    @staticmethod
    def _offset_along_axis(rect, axis, amount):
        """
        Returns a new Rectangle3d offset along one local axis by 'amount':
        negative extends Min, positive extends Max.
        """
        x, y = rect.X, rect.Y
        if axis == 'x':
            new_x = rg.Interval(x.Min + min(amount,0), x.Max + max(amount,0))
            return rg.Rectangle3d(rect.Plane, new_x, y)
        else:
            new_y = rg.Interval(y.Min + min(amount,0), y.Max + max(amount,0))
            return rg.Rectangle3d(rect.Plane, x, new_y)

    @staticmethod
    def _max_extension(slave, axis, direction, limit, master_rects):
        """
        Binary‐searches the max extension (up to 'limit') along one axis/direction
        before colliding with any master rectangles.
        """
        lo, hi, best = 0.0, limit, 0.0
        for _ in range(10):
            mid = (lo + hi) / 2.0
            test = LineUtils._offset_along_axis(slave, axis, direction * mid)
            if any(LineUtils.rects_collide(test, m) for m in master_rects):
                hi = mid
            else:
                best = mid
                lo = mid
        return best * direction

    @staticmethod
    def extend_rectangles(master_rects, slave_rects, extenddistance):
        """
        Extends each slave rectangle along its long axis by up to 'extenddistance'
        in both directions, stopping each way if it collides with any master.
        Returns a new list of extended Rectangle3d objects.
        """
        extended = []
        for slave in slave_rects:
            # pick the longer local axis
            axis = 'x' if slave.Width >= slave.Height else 'y'
            # compute negative and positive extensions
            neg_ext = LineUtils._max_extension(slave, axis, -1, extenddistance, master_rects)
            pos_ext = LineUtils._max_extension(slave, axis, +1, extenddistance, master_rects)
            x, y = slave.X, slave.Y
            # build new intervals
            new_x = (rg.Interval(x.Min + min(0,neg_ext), x.Max + max(0,pos_ext)) if axis == 'x' else x)
            new_y = (rg.Interval(y.Min + min(0,neg_ext), y.Max + max(0,pos_ext)) if axis == 'y' else y)
            
            extended.append(rg.Rectangle3d(slave.Plane, new_x, new_y))

        return extended

    @staticmethod
    def merge_intervals(intervals, tol = GLOBAL_TOL):
        """
        Merges overlapping or touching numeric intervals into a consolidated list.
        """
        if not intervals:
            return []
        sorted_int = sorted(intervals, key=lambda x: x[0])
        merged = [sorted_int[0]]
        for current in sorted_int[1:]:
            last = merged[-1]
            if current[0] <= last[1] + tol:
                merged[-1] = (last[0], max(last[1], current[1]))
            else:
                merged.append(current)
        return merged

    @staticmethod
    def encode(v, rounding=3, anglealigned = False):
        """
        Return the angle of a vector in the XY plane modulo π.
        """
        v2d = rg.Vector3d(v.X, v.Y, 0)
        if not v2d.IsZero:
            v2d.Unitize()
        a = math.atan2(v2d.Y, v2d.X)
        if a < 0:
            a += 2 * math.pi
        if anglealigned:
            return round(a, rounding)
        else:
            return round(a % math.pi, rounding)

    @staticmethod
    def find_param_group(groups, val, tol=GLOBAL_TOL):
        """
        Return existing key within tolerance or None.
        """
        for k in groups:
            if abs(k - val) < tol:
                return k
        return None

    @staticmethod
    def process_lines(rawlines, tol=GLOBAL_TOL, anglealigned = False):
        """
        Merge near-collinear lines into axis-aligned segments.
        """
        #to help out with tolerance issues
        for iter in range(3):
            extrajoin = 3.0
            lines = [rg.Line(l.From, l.To) for l in rawlines]
            for line in lines:
                line.Extend(extrajoin, extrajoin)
            groups = {}
            for ln in lines:
                angle = LineUtils.encode(ln.Direction, 10, anglealigned)
                key = LineUtils.find_param_group(groups, angle, tol)
                if key is None:
                    groups[angle] = []
                    key = angle
                groups[key].append(ln)
            processed_lines = []
            for group_angle, glines in groups.items():
                delta = math.pi/2 - group_angle
                pts = [rg.Point3d((ln.From.X + ln.To.X) * 0.5,
                                  (ln.From.Y + ln.To.Y) * 0.5,
                                  (ln.From.Z + ln.To.Z) * 0.5) for ln in glines]
                n = len(pts)
                origin = rg.Point3d(sum(pt.X for pt in pts) / n,
                                    sum(pt.Y for pt in pts) / n,
                                    sum(pt.Z for pt in pts) / n)
                T = rg.Transform.Rotation(delta, origin)
                T_inv = rg.Transform.Rotation(-delta, origin)
                rotated_lines = []
                for ln in glines:
                    ln_copy = rg.Line(ln.From, ln.To)
                    ln_copy.Transform(T)
                    rotated_lines.append(ln_copy)
                vert_groups = {}
                for ln in rotated_lines:
                    xv = (ln.From.X + ln.To.X) * 0.5
                    key = LineUtils.find_param_group(vert_groups, xv, tol)
                    if key is None:
                        vert_groups[xv] = []
                        key = xv
                    y0, y1 = sorted([ln.From.Y, ln.To.Y])
                    vert_groups[key].append((y0, y1))
                for xval, intervals in vert_groups.items():
                    merged_ints = LineUtils.merge_intervals(intervals, tol)
                    for st, en in merged_ints:
                        new_line = rg.Line(rg.Point3d(xval, st, origin.Z),
                                           rg.Point3d(xval, en, origin.Z))
                        new_line.Transform(T_inv)
                        #extend back 
                        new_line.Extend(-extrajoin, -extrajoin)
                        processed_lines.append(new_line)
            rawlines = processed_lines
        return processed_lines

    @staticmethod
    def vector_between_lines(line1, line2, tol=1e-6):
        """
        Return the shortest vector to move line1 (as infinite) onto line2 (as infinite).
        """
        p1 = line1.From
        p2 = line2.From
        v  = line2.Direction
        w0 = p1 - p2
        t  = (v * w0) / (v * v)
        projection = p2 + v * t
        return projection - p1

    @staticmethod
    def push_line(line, axis, rects):
        """
        Translates a line out of overlapping rectangles in one step:
        vertical lines move horizontally, horizontal lines move vertically.
        """
        #for debugging
        # override axis: vertical lines → horizontal movement, else → vertical
        #axis = 'x' if LineUtils.is_vertical(line) else 'y'
        if axis == 'x':
            perp_orient = 'vertical'
        else: 
            perp_orient = 'horizontal'
        # domain on the perpendicular axis
        domain = LineUtils.get_domain(line, perp_orient)
        # center coordinate on the movement axis
        c = (line.From.X + line.To.X) / 2.0 if axis == 'x' else (line.From.Y + line.To.Y) / 2.0

        # collect movement‐axis intervals from rects overlapping in perp domain
        intervals = []
        for r in rects:
            o = r.Plane.Origin
            if axis == 'x':
                perp_int = (o.Y + r.Y.Min, o.Y + r.Y.Max)
                axis_int = (o.X + r.X.Min, o.X + r.X.Max)
            else:
                perp_int = (o.X + r.X.Min, o.X + r.X.Max)
                axis_int = (o.Y + r.Y.Min, o.Y + r.Y.Max)
            if LineUtils.domains_overlap(domain, perp_int):
                intervals.append(axis_int)
        
        pushvector = rg.Vector3d(0, 0, 0)
        
        # merge and find containing interval
        for u_min, u_max in LineUtils.merge_intervals(intervals):
            if c > u_min + GLOBAL_TOL and c < u_max - GLOBAL_TOL:
                off = 0
                if abs(u_min - c) < abs(u_max - c):
                    off = (u_min - c) 
                else:
                    off = (u_max - c)
                    
                if axis == 'x':
                    pushvector = rg.Vector3d(off, 0, 0)
                else:
                    pushvector = rg.Vector3d(0, off, 0)
                
                break

        # no overlap → no move
        return pushvector

    @staticmethod
    def push_line_constrained(line, axis, rects, minpar, maxpar, bestpar):
        """
        Translates a line out of overlapping rectangles in one step:
        vertical lines move horizontally, horizontal lines move vertically.
        Will not push outside constraints, if the target push goes beyond
        constraints will fallback on bestparameter or fallback to 0 if abscent
        """
        #for debugging
        # override axis: vertical lines → horizontal movement, else → vertical
        #axis = 'x' if LineUtils.is_vertical(line) else 'y'
        if axis == 'x':
            perp_orient = 'vertical'
        else: 
            perp_orient = 'horizontal'
        
        #bestpar = None
        # domain on the perpendicular axis
        domain = LineUtils.get_domain(line, perp_orient)
        # center coordinate on the movement axis
        c = (line.From.X + line.To.X) / 2.0 if axis == 'x' else (line.From.Y + line.To.Y) / 2.0

        # collect movement‐axis intervals from rects overlapping in perp domain
        intervals = []
        for r in rects:
            o = r.Plane.Origin
            if axis == 'x':
                perp_int = (o.Y + r.Y.Min, o.Y + r.Y.Max)
                axis_int = (o.X + r.X.Min, o.X + r.X.Max)
            else:
                perp_int = (o.X + r.X.Min, o.X + r.X.Max)
                axis_int = (o.Y + r.Y.Min, o.Y + r.Y.Max)
            if LineUtils.domains_overlap(domain, perp_int):
                intervals.append(axis_int)
        
        pushvector = rg.Vector3d(0, 0, 0)
        
        # merge and find containing interval
        for u_min, u_max in LineUtils.merge_intervals(intervals):
            if c > u_min + GLOBAL_TOL and c < u_max - GLOBAL_TOL:
                off = 0
                if abs(u_min - c) < abs(u_max - c):
                    off = (u_min - c) 
                else:
                    off = (u_max - c)
                
                if axis == 'x':
                    parameter = line.From.X
                    moved = parameter+off

                    if moved < maxpar and moved > minpar:
                        pushvector = rg.Vector3d(off, 0, 0)
                    elif moved >= maxpar:
                        if bestpar:
                            offset = moved-bestpar
                        else:
                            offset = moved-maxpar
                        pushvector = rg.Vector3d(off - offset, 0, 0)

                    elif moved <= minpar:
                        if bestpar:
                            offset = moved-bestpar
                        else:
                            offset = moved-minpar
                        pushvector = rg.Vector3d(off - offset, 0, 0)

                else: #if "y"
                    parameter = line.From.Y
                    moved = parameter+off

                    if moved < maxpar and moved > minpar:
                        pushvector = rg.Vector3d(0, off, 0)
                    elif moved >= maxpar:
                        if bestpar:
                            offset = moved-bestpar
                        else:
                            offset = moved-maxpar
                        pushvector = rg.Vector3d(0, off - offset, 0)

                    elif moved <= minpar:
                        if bestpar:
                            offset = moved-bestpar
                        else:
                            offset = moved-minpar
                        pushvector = rg.Vector3d(0, off - offset, 0)
                
                break

        # no overlap → no move
        return pushvector

    def lxl(line, lines, tol=GLOBAL_TOL):
        """
        Checks whether a finite line intersects any line in a list within a
        given tolerance, returning True on the first valid interior
        intersection. The tolerance can be optionally specified.
        """
        flag = False
        
        for l in lines:
            bool, p1, p2 = rg.Intersect.Intersection.LineLine(line, l, tol, True) #finite

            if bool:
                if p1 < 1.0 - tol and p1 > tol:
                    flag =True
                    break
        return flag
    
    @staticmethod
    def lxb(line, boxes):
        """
        Determines if a line intersects any Box in a list by testing overlapping
        parametric intervals,
        returning True if any hit occurs.
        """
        boxhit = False
       
        for box in boxes:
            #this treats line as infinite, so hits are not the only parameter to judge 
            #intersections
            bhit, interval = rg.Intersect.Intersection.LineBox(line, box, 0.0)
            #ist, iend = interval
            #smaller = min(ist, iend)
            #inint = smaller > 0.0 and smaller < 1.0 #in interval
            inint = LineUtils.domains_overlap(rg.Interval(0.0, 1.0), interval)
            
            if bhit:
                if inint:
                    boxhit = True
                    break
        #return False
        return boxhit
    
    #Rhinocommon only has line x box
    @staticmethod
    def lxr(line, rectangles):
        """
        Tests intersection between a line and Rectangle3d list,
        returning True if any hit occurs.
        """
        boxes = map(LineUtils.rectangle_to_box, rectangles)
        return LineUtils.lxb(line, boxes)
    
    @staticmethod
    def line_inside_percentage(line, rectangles):
        """
        Calculates the percentage of a line's length that lies strictly within any
        given Rectangle3d objects, returning a float 0.0–100.0.
        """
        if line.Length <= 0:
            return 0.0

        intervals = []
        seg_dom = rg.Interval(0.0, 1.0)

        for rect in rectangles:
            box = LineUtils.rectangle_to_box(rect, thickness=10.0)
            hit, iv = rg.Intersect.Intersection.LineBox(line, box, GLOBAL_TOL)
            if not hit:
                continue
            t0, t1 = iv.Min, iv.Max
            lo = max(seg_dom.Min, min(t0, t1))
            hi = min(seg_dom.Max, max(t0, t1))
            if hi > lo + GLOBAL_TOL:
                intervals.append((lo, hi))

        merged = LineUtils.merge_intervals(intervals)
        covered = sum(b - a for a, b in merged)
        return (covered * 100.0)

    @staticmethod
    def filter_same_direction(line, lines, tol=GLOBAL_TOL):
        """
        Returns a list of booleans indicating if each line in 'lines' shares the
        general direction of 'line', ignoring sign. Uses dot product with tolerance
        to determine near-parallelism.
        """
        # get unit direction of reference line
        d0 = line.Direction
        d0.Unitize()
        flags = []
        for l in lines:
            # unit direction of test line
            d = l.Direction
            d.Unitize()
            # absolute dot gives 1.0 for parallel or anti-parallel
            flags.append(abs(d0 * d) >= 1.0 - tol)
        return flags

    @staticmethod
    def filter_by_flag(items, flags):
        """
        Returns only those items whose corresponding flag is True.
        """
        return list(itertools.compress(items, flags))

    @staticmethod
    def is_vertical(line, tol=1e-6):
        """
        Returns True if a line is effectively vertical within a given tolerance.
        """
        return abs(line.From.X - line.To.X) < tol
    
    @staticmethod
    def is_horizontal(line, tol=1e-6):
        """
        Returns True if a line is effectively horizontal within a given tolerance.
        """
        return abs(line.From.Y - line.To.Y) < tol

    @staticmethod
    def orientation_of_line(line, tol=1e-6):
        """
        Return Orientation constant for a line.
        """
        if LineUtils.is_vertical(line, tol):
            return LineUtils.Orientation.VERTICAL
        if LineUtils.is_horizontal(line, tol):
            return LineUtils.Orientation.HORIZONTAL
        return LineUtils.Orientation.NONORTH

    @staticmethod
    def get_position(line, orientation):
        """
        Calculates the midpoint coordinate of a line along the specified orientation
        (“vertical” or “horizontal”).
        """
        if orientation == LineUtils.Orientation.VERTICAL:
            return (line.From.X + line.To.X) / 2.0
        elif orientation == LineUtils.Orientation.HORIZONTAL:
            return (line.From.Y + line.To.Y) / 2.0
        return 0.0
    
    @staticmethod
    def get_domain(line, orientation):
        """
        Returns the sorted [min, max] coordinates of a line along the specified
        orientation (“vertical” or “horizontal”).
        """
        if orientation == LineUtils.Orientation.VERTICAL:
            return sorted([line.From.Y, line.To.Y])
        elif orientation == LineUtils.Orientation.HORIZONTAL:
            return sorted([line.From.X, line.To.X])
        return [0.0, 0.0]
    
    @staticmethod
    def domains_overlap(d1, d2, tol=1e-6):
        """
        Returns True if two numeric domains overlap within the given tolerance.
        """
        return (d1[1] + tol >= d2[0]) and (d2[1] + tol >= d1[0])
    
    @staticmethod
    def create_line(pos, domain, orientation):
        """
        Constructs a vertical or horizontal line at a fixed coordinate,
        spanning the specified domain (“vertical” or “horizontal”).
        """
        if orientation == LineUtils.Orientation.VERTICAL:
            pt1 = rg.Point3d(pos, domain[0], 0)
            pt2 = rg.Point3d(pos, domain[1], 0)
        elif orientation == LineUtils.Orientation.HORIZONTAL:
            pt1 = rg.Point3d(domain[0], pos, 0)
            pt2 = rg.Point3d(domain[1], pos, 0)
        return rg.Line(pt1, pt2)
    
    @staticmethod
    def group_lines(sorted_lines, grouper, orientation, weight_map=None):
        """
        Clusters sorted lines by proximity: lines within grouper distance and
        overlapping domains are merged into groups (“vertical” or “horizontal”).
        """
        groups = []
        for idx, line in sorted_lines:
            pos = LineUtils.get_position(line, orientation)
            dom = LineUtils.get_domain(line, orientation)
            merged = False
            
            # compute this line's weight
            if weight_map:
                weight = weight_map.get(idx, 1.0)
            else:
                weight = 1.0
            
            for g in groups:
                if abs(pos - LineUtils.get_position(g['target'], orientation)) < grouper:
                    if LineUtils.domains_overlap(dom, LineUtils.get_domain(g['target'], orientation)):
                        gdom = LineUtils.get_domain(g['target'], orientation)
                        new_dom = [min(dom[0], gdom[0]), max(dom[1], gdom[1])]
                        
                        # compute the target line's weight
                        tgt_idx = g['target_idx']                              
                        tgt_weight = weight_map.get(tgt_idx, 1.0) if weight_map else 1.0 
                        
                        if line.Length * weight >= g['target'].Length * tgt_weight:   
                            new_pos = pos 
                            g['target_idx'] = idx 
                        else:
                            new_pos = LineUtils.get_position(g['target'], orientation)
                        g['target'] = LineUtils.create_line(new_pos, new_dom, orientation)
                        g['members'].append((idx, line))
                        merged = True
                        break
            if not merged:
                # initialize target_idx for weight lookups
                groups.append({'target': line, 'members': [(idx, line)], 'target_idx': idx})
                
        return groups
    
    @staticmethod
    def transform_line(line, transform):
        """
        Applies a given Transform to a copy of a line.
        """
        tline = rg.Line(line.From, line.To)
        tline.Transform(transform)
        return tline
    
    #try moving origin line and check for intersections before operation
    @staticmethod
    def compute_transform(orig_line, target_line, orientation, avoidrects = []):
        """
        Computes a translation Transform to align one line to another along an
        orientation, optionally avoiding collisions with rectangles.
        """
        checkcollision = len(avoidrects) > 0

        if orientation == LineUtils.Orientation.VERTICAL:
            dx = target_line.From.X - orig_line.From.X
            vec = rg.Vector3d(dx, 0, 0)
            
        elif orientation == LineUtils.Orientation.HORIZONTAL:
            dy = target_line.From.Y - orig_line.From.Y
            vec = rg.Vector3d(0, dy, 0)
        else:
            return rg.Transform.Identity

        translation = rg.Transform.Translation(vec)
        if checkcollision:
            checkline = LineUtils.transform_line(orig_line, translation)
            if not LineUtils.lxr(checkline, avoidrects):
                return translation
            return rg.Transform.Identity
            
        #fallback
        return translation
        
    @staticmethod
    def grouper(lines, grouper, noflies = [], weight_map=None):
        """
        Identifies vertical and horizontal lines and groups them by proximity,
        computes translations to align group members,
        and returns a list of transforms for all lines.
        """
        vert = []
        horiz = []
        nonorth = {}
        for i, line in enumerate(lines):
            if LineUtils.is_vertical(line):
                vert.append((i, line))
            elif LineUtils.is_horizontal(line):
                horiz.append((i, line))
            else:
                nonorth[i] = rg.Transform.Identity
        vert_sorted = sorted(vert, key=lambda x: LineUtils.get_position(x[1], LineUtils.Orientation.VERTICAL))
        horiz_sorted = sorted(horiz, key=lambda x: LineUtils.get_position(x[1], LineUtils.Orientation.HORIZONTAL))
        
        transforms = {}
        for g in LineUtils.group_lines(vert_sorted, grouper, LineUtils.Orientation.VERTICAL, weight_map):
            for idx, orig in g['members']:
                transforms[idx] = LineUtils.compute_transform(orig, g['target'], LineUtils.Orientation.VERTICAL, noflies)

        for g in LineUtils.group_lines(horiz_sorted, grouper, LineUtils.Orientation.HORIZONTAL, weight_map):
            for idx, orig in g['members']:
                transforms[idx] = LineUtils.compute_transform(orig, g['target'], LineUtils.Orientation.HORIZONTAL, noflies)
                
        transforms.update(nonorth)
        return [transforms[i] for i in sorted(transforms.keys())]
    
    @staticmethod
    def filter_unique_nonzero(values, tol = GLOBAL_TOL):
        """
        Filters a list of numeric values, returning only those non-zero above
        tolerance and unique within tolerance.
        """
        unique = []
        for v in values:
            if abs(v) > tol and not any(abs(v - u) <= tol for u in unique):
                unique.append(v)
        return unique
        
    @staticmethod
    def largest_by_abs(values):
        """
        Returns the value with the greatest absolute magnitude from a list,
        or zero if the list is empty.
        """
        if len(values):
            return max(values, key=abs)
        else:
            return 0.0
            
    @staticmethod
    def consecutive_pairs(lst):
        """
        Converts a list of values into a list of consecutive two-element pairs.
        """
        if len(lst) < 2: return []
        return [[lst[i], lst[i+1]] for i in range(len(lst)-1)]

    @staticmethod
    def weighted_average(values, weights):
        """
        Calculates the weighted average of a list of numeric values given corresponding
        weights, returning a float. If weights sum to zero or lists mismatch, returns 0.0.
        """
        # mismatch or empty -> zero
        if len(values) != len(weights) or not values:
            return 0.0

        total = 0.0
        wsum = 0.0
        for v, w in zip(values, weights):
            total += v * w
            wsum += w

        # avoid division by zero
        if abs(wsum) < GLOBAL_TOL:
            return 0.0

        return total / wsum

    @staticmethod
    def unique_points(points, tol=1e-8):
        """
        Return unique 2D points (XY plane) within a given tolerance.
        """
        unique = []
        for p in points:
            if not any(abs(p.X - q.X) < tol and abs(p.Y - q.Y) < tol for q in unique):
                unique.append(p)
        return unique

    @staticmethod
    def _circumcircle_contains(a, b, c, p):
        """
        Return True if p lies inside the circumcircle of triangle (a, b, c).
        """
        ax, ay = a.X, a.Y
        bx, by = b.X, b.Y
        cx, cy = c.X, c.Y
        dx, dy = p.X, p.Y
        d = 2*(ax*(by-cy) + bx*(cy-ay) + cx*(ay-by))
        if abs(d) < 1e-8:
            return False
        asq = ax*ax + ay*ay
        bsq = bx*bx + by*by
        csq = cx*cx + cy*cy
        ux = (asq*(by-cy) + bsq*(cy-ay) + csq*(ay-by)) / d
        uy = (asq*(cx-bx) + bsq*(ax-cx) + csq*(bx-ax)) / d
        return ((dx-ux)**2 + (dy-uy)**2) < ((ax-ux)**2 + (ay-uy)**2)

    @staticmethod
    def _delaunay(points):
        """
        Bowyer–Watson Delaunay triangulation of 2D points.
        Returns list of index triples into `points`.
        """
        pts = [(p.X, p.Y) for p in points]
        n = len(pts)
        xs, ys = zip(*pts)
        xmin, xmax = min(xs), max(xs)
        ymin, ymax = min(ys), max(ys)
        dx, dy = xmax-xmin, ymax-ymin
        dmax = max(dx, dy)
        mx, my = (xmin+xmax)/2.0, (ymin+ymax)/2.0
        super_pts = [
            (mx-2*dmax, my-dmax),
            (mx,        my+2*dmax),
            (mx+2*dmax, my-dmax)
        ]
        ext = pts + super_pts
        tris = [(n, n+1, n+2)]
        for i, (x, y) in enumerate(pts):
            bad, edges = [], {}
            for tri in tris:
                xi, yi = ext[tri[0]]; a = rg.Point3d(xi, yi, 0)
                xj, yj = ext[tri[1]]; b = rg.Point3d(xj, yj, 0)
                xk, yk = ext[tri[2]]; c = rg.Point3d(xk, yk, 0)
                p = rg.Point3d(x, y, 0)
                if LineUtils._circumcircle_contains(a, b, c, p):
                    bad.append(tri)
                    for u, v in ((tri[0],tri[1]), (tri[1],tri[2]), (tri[2],tri[0])):
                        key = tuple(sorted((u, v)))
                        edges[key] = edges.get(key, 0) + 1
            tris = [t for t in tris if t not in bad]
            for (u, v), cnt in edges.items():
                if cnt == 1:
                    tris.append((u, v, i))
        # remove triangles using super-vertices
        return [t for t in tris if all(j < n for j in t)]

    @staticmethod
    def _alpha_shape_edges(points, alpha):
        """
        Return boundary edges of the α-shape for 2D points.
        """
        tris = LineUtils._delaunay(points)
        edge_count = {}
        for tri in tris:
            a, b, c = (points[j] for j in tri)
            ab, ac = b-a, c-a
            d = 2*(ab.X*ac.Y - ab.Y*ac.X)
            if abs(d) < 1e-8:
                continue
            asq = ab.X*ab.X + ab.Y*ab.Y
            csq = ac.X*ac.X + ac.Y*ac.Y
            cx = (ac.Y*asq - ab.Y*csq) / d
            cy = (ab.X*csq - ac.X*asq) / d
            if math.hypot(cx, cy) <= alpha:
                for u, v in ((tri[0],tri[1]), (tri[1],tri[2]), (tri[2],tri[0])):
                    key = tuple(sorted((u, v)))
                    edge_count[key] = edge_count.get(key, 0) + 1
        return [edge for edge, cnt in edge_count.items() if cnt == 1]

    @staticmethod
    def estimate_alpha(points):
        """
        Estimate a good alpha value based on point spread.
        """
        unique = LineUtils.unique_points(points)
        if len(unique) < 2:
            return 1.0
        xs = [p.X for p in unique]; ys = [p.Y for p in unique]
        dx = max(xs) - min(xs); dy = max(ys) - min(ys)
        diag = math.hypot(dx, dy)
        finetune = 5.0 #extra multiplier hand picked
        return (diag / math.sqrt(len(unique))) * finetune

    @staticmethod
    def concave_hull_points(points, alpha=None):
        """
        Return list of Lines forming the concave hull of Point3d list (XY).
        """
        pts2d = [rg.Point3d(p.X, p.Y, 0) for p in points]
        unique = LineUtils.unique_points(pts2d)
        if alpha is None:
            alpha = LineUtils.estimate_alpha(unique)
        edges = LineUtils._alpha_shape_edges(unique, alpha)
        return [rg.Line(unique[i], unique[j]) for i, j in edges]

    @staticmethod
    def concave_hull_lines(lines, alpha=None):
        """
        Return concave hull of line segments by their endpoints.
        """
        pts = []
        for ln in lines:
            pts.append(rg.Point3d(ln.From.X, ln.From.Y, 0))
            pts.append(rg.Point3d(ln.To.X,   ln.To.Y,   0))
        return LineUtils.concave_hull_points(pts, alpha)

    @staticmethod
    def join_lines(lines, mergecollinear=True, tol=1e-8):
        """
        Join lines into polylines by connecting touching endpoints.
        """
        endpoints = []
        for ln in lines:
            endpoints.append(rg.Point3d(ln.From.X, ln.From.Y, 0))
            endpoints.append(rg.Point3d(ln.To.X,   ln.To.Y,   0))
        unique = {}
        for p in endpoints:
            key = (round(p.X/tol), round(p.Y/tol))
            if key not in unique:
                unique[key] = (p.X, p.Y)
        adj = {}
        for idx, ln in enumerate(lines):
            p1 = (round(ln.From.X/tol), round(ln.From.Y/tol))
            p2 = (round(ln.To.X/tol),   round(ln.To.Y/tol))
            adj.setdefault(p1, []).append((p2, idx))
            adj.setdefault(p2, []).append((p1, idx))
        visited = set()
        polylines = []
        for idx, ln in enumerate(lines):
            if idx in visited:
                continue
            start = (round(ln.From.X/tol), round(ln.From.Y/tol))
            comp_keys = set([start]); comp_lines = set()
            queue = [start]
            while queue:
                k = queue.pop(0)
                for neigh, li in adj.get(k, []):
                    comp_lines.add(li)
                    if neigh not in comp_keys:
                        comp_keys.add(neigh)
                        queue.append(neigh)
            deg_one = [k for k in comp_keys if sum(1 for (n,li) in adj[k] if li in comp_lines) == 1]
            cur = deg_one[0] if deg_one else start
            pts_seq = [cur]
            while True:
                found = False
                for neigh, li in adj[cur]:
                    if li in comp_lines and li not in visited:
                        visited.add(li)
                        pts_seq.append(neigh)
                        cur = neigh
                        found = True
                        break
                if not found:
                    break
            pline = rg.Polyline([rg.Point3d(unique[k][0], unique[k][1], 0) for k in pts_seq])
            polylines.append(pline)
        
        if mergecollinear:
            for poly in polylines:
                poly.MergeColinearSegments(GLOBAL_TOL, True)
        
        return polylines
    
    @staticmethod
    def _point_in_poly(pt, polyl, tol=1e-6):
        """
        returns True if pt is inside or on boundary.
        Uses distance-to-edge for boundary, then ray-casting for in/out.
        """
        # prepare closed vertex list
        pts = list(polyl)
        if not pts:
            return False
        if pts[0] != pts[-1]:
            pts.append(pts[0])
        x, y = pt.X, pt.Y
        
        # if the point is very close to any edge, count it as inside
        for i in range(len(pts)-1):
            if LineUtils._dist_point_seg(pt, pts[i], pts[i+1], tol) <= tol:
                return True
        
        # ray-casting
        inside = False
        for i in range(len(pts)-1):
            xi, yi = pts[i].X, pts[i].Y
            xj, yj = pts[i+1].X, pts[i+1].Y
            # check edge straddles horizontal ray
            if ((yi > y) != (yj > y)):
                xint = xi + (y - yi) * (xj - xi) / (yj - yi)
                if x < xint:
                    inside = not inside
        return inside

    @staticmethod
    def _dist_point_seg(pt, a, b, tol=1e-6):
        """
        Euclidean distance from point pt to segment AB.
        """
        vx, vy = b.X - a.X, b.Y - a.Y
        wx, wy = pt.X - a.X, pt.Y - a.Y
        denom = vx*vx + vy*vy
        if denom < tol:
            return math.hypot(wx, wy)
        t = (wx*vx + wy*vy) / denom
        if t <= 0:
            return math.hypot(wx, wy)
        if t >= 1:
            dx, dy = pt.X - b.X, pt.Y - b.Y
            return math.hypot(dx, dy)
        projx = a.X + t * vx
        projy = a.Y + t * vy
        return math.hypot(pt.X - projx, pt.Y - projy)

    @staticmethod
    def _interp(pa, pb, va, vb, iso, tol=1e-6):
        """
        Linear interpolate between points pa and pb where sdf crosses iso.
        """
        if abs(vb - va) < tol:
            t = 0.5
        else:
            t = (iso - va) / float(vb - va)
        return rg.Point3d(
            pa.X + t*(pb.X - pa.X),
            pa.Y + t*(pb.Y - pa.Y),
            0
        )

    @staticmethod
    def offset_polyline(pline, offset, resolution=50, tol=1e-6):
        """
        SDF-based offset of a planar polyline (XY plane only).
        returns list of Polylines (possibly multiple loops).
        """
        # close the loop
        verts = list(pline)
        if verts and verts[0] != verts[-1]:
            verts.append(verts[0])
    
        # compute bbox and pad offset margin
        margin = 0.1
        xs = [p.X for p in verts]
        ys = [p.Y for p in verts]
        
        minx, maxx = min(xs), max(xs)
        miny, maxy = min(ys), max(ys)
        
        w0 = maxx - minx
        h0 = maxy - miny
        
        pad_x = margin * w0
        pad_y = margin * h0
        m = abs(offset)
        
        minx -= pad_x + m
        maxx += pad_x + m
        miny -= pad_y + m
        maxy += pad_y + m
    
        # grid dimensions
        width, height = maxx - minx, maxy - miny
        cell = max(width, height) / float(resolution)
        nx, ny = int(round(width/cell)), int(round(height/cell))
    
        # sample signed distance field
        vals = [[0.0]*(nx+1) for _ in range(ny+1)]
        for i in range(ny+1):
            y = miny + i*cell
            for j in range(nx+1):
                x = minx + j*cell
                p = rg.Point3d(x, y, 0)
                inside = LineUtils._point_in_poly(p, verts, tol)
                dmin = min(
                    LineUtils._dist_point_seg(p, a, b, tol)
                    for a, b in zip(verts, verts[1:])
                )
                vals[i][j] = -dmin if inside else dmin
    
        # marching squares at iso=offset
        iso, lines = offset, []
        for i in range(ny):
            for j in range(nx):
                v0, v1 = vals[i][j],     vals[i][j+1]
                v3, v2 = vals[i+1][j],   vals[i+1][j+1]
                pts = [
                    rg.Point3d(minx+j*cell,   miny+i*cell,   0),
                    rg.Point3d(minx+(j+1)*cell, miny+i*cell,   0),
                    rg.Point3d(minx+(j+1)*cell, miny+(i+1)*cell, 0),
                    rg.Point3d(minx+j*cell,     miny+(i+1)*cell, 0)
                ]
                cs = [v >= iso for v in (v0, v1, v2, v3)]
                case = (cs[0]<<3)|(cs[1]<<2)|(cs[2]<<1)|cs[3]
                if case in (0, 15):
                    continue
    
                edges = []
                for k, (c_curr, c_next) in enumerate(zip(cs, cs[1:]+cs[:1])):
                    if c_curr != c_next:
                        a, b = pts[k], pts[(k+1)%4]
                        va, vb = (v0, v1, v2, v3)[k], (v1, v2, v3, v0)[k]
                        edges.append(LineUtils._interp(a, b, va, vb, iso, tol))
    
                if len(edges) == 2:
                    lines.append(rg.Line(edges[0], edges[1]))
                elif len(edges) == 4:
                    if case in (5, 10):
                        lines.append(rg.Line(edges[0], edges[3]))
                        lines.append(rg.Line(edges[1], edges[2]))
                    else:
                        lines.append(rg.Line(edges[0], edges[1]))
                        lines.append(rg.Line(edges[2], edges[3]))
    
        return LineUtils.join_lines(lines, mergecollinear=True, tol=tol)

    @staticmethod
    def filter_external_polylines(polylines, tol=1e-6):
        """
        Return only those closed polylines that are not fully contained
        within any other polyline in the list.
        """
        external = []
        for i, pl in enumerate(polylines):
            # get distinct vertices (drop closing duplicate)
            pts = list(pl)
            if pts and pts[0] == pts[-1]:
                pts = pts[:-1]
            # check if all vertices lie inside some other polyline
            inside_any = False
            for j, other in enumerate(polylines):
                if i == j:
                    continue
                other_pts = list(other)
                if other_pts and other_pts[0] == other_pts[-1]:
                    other_pts = other_pts[:-1]
                # test all vertices of pl against other
                if all(LineUtils._point_in_poly(p, other_pts, tol) for p in pts):
                    inside_any = True
                    break
            if not inside_any:
                external.append(pl)
        return external

    @staticmethod
    def is_point_in_any_polyline(pt, polylines, tol=1e-6):
        """
        Return True if point pt lies inside or on the boundary of
        any closed polyline in the given list.
        """
        for pl in polylines:
            pts = list(pl)
            # drop closing duplicate
            if pts and pts[0] == pts[-1]:
                pts = pts[:-1]
            if LineUtils._point_in_poly(pt, pts, tol):
                return True
        return False

    @staticmethod
    def time_block(name):
        """
        Use as: with LineUtils.time_block('name of what is being profiled')
        """
        class _Timer(object):
            def __enter__(self_inner):
                self_inner.t0 = time.clock()
                return self_inner
            def __exit__(self_inner, exc_type, exc, tb):
                dt = time.clock() - self_inner.t0
                print('%s took %.3f s' % (name, dt))
        return _Timer()

    @staticmethod
    def profile(func):
        """
        Use as decorator: @LineUtils.profile
        """
        def wrapper(*args, **kwargs):
            t0 = time.clock()
            result = func(*args, **kwargs)
            dt = time.clock() - t0
            print('%s took %.3f s' % (func.__name__, dt))
            return result
        return wrapper

    @staticmethod
    def timeout(seconds):
        """
        Use as decorator: @LineUtils.timeout(5)
        If the wrapped function doesn’t finish in <seconds>, returns "expired".
        """
        def decorator(func):
            def wrapper(*args, **kwargs):
                result = [None]
                exception = [None]
                def target():
                    try:
                        result[0] = func(*args, **kwargs)
                    except Exception as e:
                        exception[0] = e

                thread = System.Threading.Thread(System.Threading.ThreadStart(target))
                thread.IsBackground = True
                thread.Start()

                if not thread.Join(int(seconds * 1000)):
                    thread.Abort()
                    return "expired"

                if exception[0]:
                    # re-raise original exception
                    raise exception[0]
                return result[0]
            return wrapper
        return decorator

    @staticmethod
    def run_with_timeout(func, seconds):
        """
        Use as: LineUtils.run_with_timeout(lambda: your_func(arg1, arg2), 5)
        Returns the function’s result, or "expired" if it times out.
        """
        result = [None]
        exception = [None]
        def target():
            try:
                result[0] = func()
            except Exception as e:
                exception[0] = e

        thread = System.Threading.Thread(System.Threading.ThreadStart(target))
        thread.IsBackground = True
        thread.Start()

        if not thread.Join(int(seconds * 1000)):
            thread.Abort()
            return "expired"

        if exception[0]:
            raise exception[0]
        return result[0]

    @staticmethod
    def parallel(func, args_list, max_threads=4):
        """
        Use as: results = LineUtils.parallel(my_func, [a, b, c], max_threads=4)
        Runs my_func(item) over each item in args_list in up to max_threads
        concurrent threads. Returns a list of results in the same order.
        If any call raises, returns "failed to compute"
        """
        n = len(args_list)
        results = [None] * n
        exceptions = [None] * n
        idx = [0]
        lock = System.Object()

        def worker():
            while True:
                System.Threading.Monitor.Enter(lock)
                try:
                    if idx[0] >= n:
                        break
                    i = idx[0]
                    idx[0] += 1
                finally:
                    System.Threading.Monitor.Exit(lock)

                try:
                    results[i] = func(args_list[i])
                except Exception as e:
                    exceptions[i] = e

        # spawn up to max_threads workers
        threads = []
        count = max_threads if max_threads < n else n
        for _ in range(count):
            t = System.Threading.Thread(System.Threading.ThreadStart(worker))
            t.IsBackground = True
            t.Start()
            threads.append(t)

        # wait for all to finish
        for t in threads:
            t.Join()

        # re-raise first exception, if any
        for e in exceptions:
            if e:
                return "failed to compute"

        return results

    @staticmethod
    def clip_line_rectangle(line, rect, tol=GLOBAL_TOL):
        """
        Clip a line segment to a rectangle using the Liang-Barsky algorithm.
        """
        bb = rect.BoundingBox
        x0, y0, z0 = line.From.X, line.From.Y, line.From.Z
        x1, y1, z1 = line.To.X, line.To.Y, line.To.Z
        dx = x1 - x0
        dy = y1 - y0
        dz = z1 - z0
        p = [-dx, dx, -dy, dy]
        q = [x0 - bb.Min.X, bb.Max.X - x0, y0 - bb.Min.Y, bb.Max.Y - y0]
        u1, u2 = 0.0, 1.0
        for pi, qi in zip(p, q):
            if abs(pi) < tol:
                if qi < 0:
                    return []
            else:
                t = qi / float(pi)
                if pi < 0:
                    if t > u2:
                        return []
                    if t > u1:
                        u1 = t
                else:
                    if t < u1:
                        return []
                    if t < u2:
                        u2 = t
        if u2 < u1:
            return []
        p0 = rg.Point3d(x0 + u1*dx, y0 + u1*dy, z0 + u1*dz)
        p1 = rg.Point3d(x0 + u2*dx, y0 + u2*dy, z0 + u2*dz)
        return [rg.Line(p0, p1)]

    @staticmethod
    def polyline_intersection_rect(pline, rect, tol=GLOBAL_TOL):
        """
        Return list of Polyline segments of `pline` inside `rect`.
        """
        inside = []
        current = []
        pts = list(pline)
        for a, b in zip(pts, pts[1:]):
            segs = LineUtils.clip_line_rectangle(rg.Line(a, b), rect, tol)
            if not segs:
                if current:
                    inside.append(rg.Polyline(current))
                    current = []
                continue
            seg = segs[0]
            if not current:
                current.append(seg.From)
            current.append(seg.To)
        if current:
            inside.append(rg.Polyline(current))
        return inside

    @staticmethod
    def polyline_difference_rect(pline, rect, tol=GLOBAL_TOL):
        """
        Return polyline segments of `pline` outside `rect`.
        """
        segments = []
        pts = list(pline)
        for a, b in zip(pts, pts[1:]):
            outs = LineUtils.line_outside_rectangles(rg.Line(a, b), [rect], 10.0, tol)
            segments.extend([rg.Polyline([seg.From, seg.To]) for seg in outs])
        return segments
    
    @staticmethod
    def segment_to_segment_distance(seg1, seg2):
        """
        Compute the shortest distance between two finite line segments seg1 and seg2 (rg.Line).
        """
        A = seg1.From
        B = seg1.To
        C = seg2.From
        D = seg2.To
    
        # direction vectors
        u = B - A
        v = D - C
        w0 = A - C
    
        a = u * u  # dot(u, u)
        b = u * v  # dot(u, v)
        c = v * v  # dot(v, v)
        d = u * w0 # dot(u, w0)
        e = v * w0 # dot(v, w0)
    
        denom = a * c - b * b
        # initial (s, t) for infinite lines
        if abs(denom) > 1e-12:
            s = (b * e - c * d) / denom
            t = (a * e - b * d) / denom
        else:
            # parallel or nearly parallel
            s = 0.0
            if abs(c) > 1e-12:
                t = e / c
            else:
                t = 0.0
    
        # clamp s, t to [0,1]
        if s < 0.0:
            s = 0.0
        elif s > 1.0:
            s = 1.0
    
        if t < 0.0:
            t = 0.0
        elif t > 1.0:
            t = 1.0
    
        # After clamping one, recompute the other if needed
        # Check if s was clamped
        if s == 0.0 or s == 1.0:
            # solve for t that minimizes distance to P(s)
            Ps = rg.Point3d(
                A.X + u.X * s,
                A.Y + u.Y * s,
                A.Z + u.Z * s
            )
            w = Ps - C
            if abs(c) > 1e-12:
                t_candidate = (v * w) / c
                if t_candidate < 0.0:
                    t = 0.0
                elif t_candidate > 1.0:
                    t = 1.0
                else:
                    t = t_candidate
    
        # Check if t was clamped
        if t == 0.0 or t == 1.0:
            # solve for s that minimizes distance to Q(t)
            Qt = rg.Point3d(
                C.X + v.X * t,
                C.Y + v.Y * t,
                C.Z + v.Z * t
            )
            w = A - Qt
            if abs(a) > 1e-12:
                s_candidate = (u * w) / a
                if s_candidate < 0.0:
                    s = 0.0
                elif s_candidate > 1.0:
                    s = 1.0
                else:
                    s = s_candidate
    
        # Closest points on each segment
        P_closest = rg.Point3d(
            A.X + u.X * s,
            A.Y + u.Y * s,
            A.Z + u.Z * s
        )
        Q_closest = rg.Point3d(
            C.X + v.X * t,
            C.Y + v.Y * t,
            C.Z + v.Z * t
        )
    
        return P_closest.DistanceTo(Q_closest)

    @staticmethod
    def simplify_polyline(pline, tol=GLOBAL_TOL):
        """
        Simplify a polyline using the Ramer-Douglas-Peucker algorithm.
        """
        pts = list(pline)
        if len(pts) <= 2:
            return rg.Polyline(pts)
        keep = [0, len(pts)-1]
        stack = [(0, len(pts)-1)]
        while stack:
            s, e = stack.pop()
            a, b = pts[s], pts[e]
            ax, ay, az = a.X, a.Y, a.Z
            bx, by, bz = b.X, b.Y, b.Z
            dx, dy, dz = bx-ax, by-ay, bz-az
            d2 = dx*dx + dy*dy + dz*dz
            maxd = -1.0
            idx = None
            for i in range(s+1, e):
                p = pts[i]
                if d2 == 0:
                    dist = a.DistanceTo(p)
                else:
                    t = ((p.X-ax)*dx + (p.Y-ay)*dy + (p.Z-az)*dz) / d2
                    t = max(0.0, min(1.0, t))
                    proj = rg.Point3d(ax+t*dx, ay+t*dy, az+t*dz)
                    dist = p.DistanceTo(proj)
                if dist > maxd:
                    maxd = dist
                    idx = i
            if maxd > tol and idx is not None:
                stack.append((s, idx))
                stack.append((idx, e))
            else:
                keep.append(e)
        keep = sorted(set(keep))
        simp = [pts[i] for i in keep]
        return rg.Polyline(simp)

    @staticmethod
    def smooth_polyline(pline, factor=0.25, iterations=1):
        """
        Smooth a polyline using Chaikin's algorithm.
        """
        pts = list(pline)
        closed = pts[0] == pts[-1]
        for _ in range(iterations):
            new_pts = []
            rng = range(len(pts)-1) if not closed else range(len(pts))
            for i in rng:
                p0 = pts[i]
                p1 = pts[(i+1) % len(pts)]
                q = rg.Point3d(
                    p0.X + factor*(p1.X - p0.X),
                    p0.Y + factor*(p1.Y - p0.Y),
                    p0.Z + factor*(p1.Z - p0.Z)
                )
                r = rg.Point3d(
                    p1.X - factor*(p1.X - p0.X),
                    p1.Y - factor*(p1.Y - p0.Y),
                    p1.Z - factor*(p1.Z - p0.Z)
                )
                new_pts.extend([q, r])
            if not closed:
                new_pts = [pts[0]] + new_pts + [pts[-1]]
            else:
                new_pts.append(new_pts[0])
            pts = new_pts
        return rg.Polyline(pts)

    @staticmethod
    def _cross2d(a, b, c):
        return (b.X - a.X)*(c.Y - a.Y) - (b.Y - a.Y)*(c.X - a.X)

    @staticmethod
    def convex_hull(points):
        """
        Return the convex hull of 2D points.
        """
        pts = LineUtils.unique_points([rg.Point3d(p.X, p.Y, 0) for p in points])
        if len(pts) <= 1:
            return pts
        pts.sort(key=lambda p: (p.X, p.Y))
        lower = []
        for p in pts:
            while len(lower) >= 2 and LineUtils._cross2d(lower[-2], lower[-1], p) <= 0:
                lower.pop()
            lower.append(p)
        upper = []
        for p in reversed(pts):
            while len(upper) >= 2 and LineUtils._cross2d(upper[-2], upper[-1], p) <= 0:
                upper.pop()
            upper.append(p)
        return lower[:-1] + upper[:-1]

    @staticmethod
    def laplacian_smooth_polyline(pline, factor=0.5, iterations=1):
        """
        Smooth a polyline using Laplacian smoothing.

        Each interior vertex moves toward the average of its neighbors by
        `factor` on each iteration. Endpoints of an open polyline are kept
        fixed. A closed polyline is treated as a loop.
        """
        pts = list(pline)
        if len(pts) <= 2:
            return rg.Polyline(pts)
        closed = pts[0] == pts[-1]
        for _ in range(iterations):
            new_pts = [pts[0]] if not closed else []
            n = len(pts) - 1 if closed else len(pts)
            for i in range(1 if not closed else 0, n - 1):
                prev_pt = pts[i - 1]
                next_pt = pts[(i + 1) % len(pts)]
                cur_pt = pts[i]
                x = cur_pt.X + factor * ((prev_pt.X + next_pt.X) / 2.0 - cur_pt.X)
                y = cur_pt.Y + factor * ((prev_pt.Y + next_pt.Y) / 2.0 - cur_pt.Y)
                z = cur_pt.Z + factor * ((prev_pt.Z + next_pt.Z) / 2.0 - cur_pt.Z)
                new_pts.append(rg.Point3d(x, y, z))
            if closed:
                new_pts.append(new_pts[0])
            else:
                new_pts.append(pts[-1])
            pts = new_pts
        return rg.Polyline(pts)

    @staticmethod
    def minimum_bounding_rectangle(points):
        """
        Compute oriented minimum bounding rectangle of points.
        """
        hull = LineUtils.convex_hull(points)
        if not hull:
            return None
        if len(hull) == 1:
            p = hull[0]
            plane = rg.Plane(p, rg.Vector3d.XAxis, rg.Vector3d.YAxis)
            return rg.Rectangle3d(plane, 0.0, 0.0)
        min_area = None
        best_rect = None
        n = len(hull)
        for i in range(n):
            p0 = hull[i]
            p1 = hull[(i+1) % n]
            ang = math.atan2(p1.Y - p0.Y, p1.X - p0.X)
            cos_a = math.cos(-ang)
            sin_a = math.sin(-ang)
            xs = []
            ys = []
            for p in hull:
                x = p.X * cos_a - p.Y * sin_a
                y = p.X * sin_a + p.Y * cos_a
                xs.append(x)
                ys.append(y)
            minx, maxx = min(xs), max(xs)
            miny, maxy = min(ys), max(ys)
            area = (maxx - minx) * (maxy - miny)
            if min_area is None or area < min_area:
                min_area = area
                cx = (minx + maxx) / 2.0
                cy = (miny + maxy) / 2.0
                cos_ang = math.cos(ang)
                sin_ang = math.sin(ang)
                center = rg.Point3d(
                    cos_ang*cx - sin_ang*cy,
                    sin_ang*cx + cos_ang*cy,
                    0
                )
                plane = rg.Plane(center,
                                 rg.Vector3d(cos_ang, sin_ang, 0),
                                 rg.Vector3d(-sin_ang, cos_ang, 0))
                xint = rg.Interval(minx - cx, maxx - cx)
                yint = rg.Interval(miny - cy, maxy - cy)
                best_rect = rg.Rectangle3d(plane, xint, yint)
        return best_rect

    @staticmethod
    def _segments_intersect(a1, a2, b1, b2, tol=GLOBAL_TOL):
        def ccw(p1, p2, p3):
            return (p3.Y - p1.Y)*(p2.X - p1.X) > (p2.Y - p1.Y)*(p3.X - p1.X)
        if (max(a1.X, a2.X) + tol < min(b1.X, b2.X) or
            max(b1.X, b2.X) + tol < min(a1.X, a2.X) or
            max(a1.Y, a2.Y) + tol < min(b1.Y, b2.Y) or
            max(b1.Y, b2.Y) + tol < min(a1.Y, a2.Y)):
            return False
        d1 = ccw(a1, b1, b2)
        d2 = ccw(a2, b1, b2)
        d3 = ccw(a1, a2, b1)
        d4 = ccw(a1, a2, b2)
        if d1 != d2 and d3 != d4:
            return True
        return False

    @staticmethod
    def sweep_line_intersections(lines, tol=GLOBAL_TOL):
        """
        Find all segment index pairs that intersect using a sweep algorithm.
        """
        events = []
        for idx, ln in enumerate(lines):
            minx = min(ln.From.X, ln.To.X)
            maxx = max(ln.From.X, ln.To.X)
            events.append((minx, 0, idx))
            events.append((maxx, 1, idx))
        events.sort()
        active = []
        hits = []
        for x, typ, idx in events:
            if typ == 0:
                for j in active:
                    if LineUtils._segments_intersect(lines[idx].From, lines[idx].To,
                                                    lines[j].From, lines[j].To, tol):
                        hits.append((idx, j))
                active.append(idx)
            else:
                if idx in active:
                    active.remove(idx)
        return hits

    @staticmethod
    def snap_point_to_grid(pt, step):
        """
        Snap a point to the nearest grid location.
        """
        x = round(pt.X / step) * step
        y = round(pt.Y / step) * step
        z = round(pt.Z / step) * step
        return rg.Point3d(x, y, z)

    @staticmethod
    def snap_line_to_grid(line, step):
        """
        Snap both endpoints of a line to the grid.
        """
        return rg.Line(LineUtils.snap_point_to_grid(line.From, step),
                       LineUtils.snap_point_to_grid(line.To, step))

    @staticmethod
    def is_polyline_self_intersecting(pline, tol=1e-8):
        """
        Return True if `pline` self-intersects.
        """
        pts = list(pline)
        segs = [(pts[i], pts[i+1]) for i in range(len(pts)-1)]
        for i in range(len(segs)):
            for j in range(i+1, len(segs)):
                if j == i+1:
                    continue
                if LineUtils._segments_intersect(segs[i][0], segs[i][1], segs[j][0], segs[j][1], tol):
                    return True
        return False

    @staticmethod
    def safe_batch(func, args_list, timeout_sec=5, max_threads=4):
        """
        Run parrallel compute with per-call timeout.
        """
        def wrapped(arg):
            return LineUtils.run_with_timeout(lambda: func(arg), timeout_sec)
        return LineUtils.parallel(wrapped, args_list, max_threads)

    # — Finds individual “measure” tokens (mixed, fraction, int, or feet-only) —
    MEASURE_RE = re.compile(r"""
        (?:
            # 1) Feet + inches (mixed/fraction/int), e.g. -2'-1 1/4", 3'-3/8", 4'-6"
            -?\d+\s*'\s*(?:-\s*)?          # signed feet + apostrophe + optional dash
            (?:
                \d+\s+\d+/\d+             # mixed inches (1 1/4)
              |
                \d+/\d+                   # fraction only (3/8)
              |
                \d+                       # integer inches (6)
            )
            \s*"
          |
            # 2) Mixed inches without feet, e.g. -1 1/4"
            -?\d+\s+\d+/\d+\s*"
          |
            # 3) Fraction only, e.g. -3/8"
            -?\d+/\d+\s*"
          |
            # 4) Integer inches without feet, e.g. -12"
            -?\d+\s*"
          |
            # 5) Feet only, e.g. -6'
            -?\d+\s*'
        )
    """, re.VERBOSE)

    # — Breaks a single token into feet + one of (mixed, fraction, int) inches —
    PARTS_RE = re.compile(r"""
        ^\s*
        (?:(?P<feet>\d+)\s*'\s*(?:-\s*)?)?   # optional feet (e.g. 2')
        (?:
            (?P<inch_int>\d+)\s+(?P<num>\d+)\s*/\s*(?P<den>\d+)  # mixed inches (1 1/4)
          |
            (?P<num2>\d+)\s*/\s*(?P<den2>\d+)                    # fraction only (3/8)
          |
            (?P<inch_only>\d+)                                  # integer inches (6)
        )
        \s*"
        \s*$
    """, re.VERBOSE)

    @staticmethod
    def parse_measure(tok):
        """
        Parse a feet/inches token (possibly negative) into a float number of inches.
        
        Supported forms:
          "0"           →   0.0
          "1'-0\""      →  12.0
          "3/4\""       →   0.75
          "1 1/4\""     →   1.25
          "2'-1 1/8\""  →  25.125
          "-4' 0\""     → -48.0
          "-3/8\""      →  -0.375
          "6'"          →  72.0
          "-6'"         → -72.0

        Returns a float, or an error string if parsing fails.
        """
        tok = tok.strip()
        
        # 1) Handle leading minus
        sign = 1.0
        if tok.startswith('-'):
            sign = -1.0
            tok = tok[1:].strip()

        # 2) Raw integer (no units), e.g. "0", "5"
        if tok.isdigit():
            return sign * float(tok)

        # 3) Feet-only, e.g. "6'" or "-4'"
        if tok.endswith("'"):
            num_feet = tok[:-1].strip()
            if not num_feet.isdigit():
                return "Can't parse measure %r" % (tok + "'")
            return sign * (int(num_feet) * 12.0)

        # 4) Mixed/fraction/int inches (with optional feet)
        m = LineUtils.PARTS_RE.match(tok)
        if not m:
            return "Can't parse measure %r" % tok

        feet = int(m.group('feet')) if m.group('feet') else 0
        inches = 0.0

        # 4a) Mixed inches: "inch_int num/den"
        if m.group('inch_int') and m.group('num') and m.group('den'):
            inch_int = int(m.group('inch_int'))
            num = int(m.group('num'))
            den = int(m.group('den'))
            inches = inch_int + (num / float(den))

        # 4b) Fraction-only: "num2/den2"
        elif m.group('num2') and m.group('den2'):
            num2 = int(m.group('num2'))
            den2 = int(m.group('den2'))
            inches = num2 / float(den2)

        # 4c) Integer-only inches
        elif m.group('inch_only'):
            inches = int(m.group('inch_only'))

        total_inches = feet * 12.0 + inches
        return sign * total_inches

    @staticmethod
    def parse_scale(s):
        """
        Parse a scale string like “1\" = 1'-0\"" (or variations) and return:
          - If two measures found → (real_inches / draw_inches) as float.
          - If one measure found → its inch value (float).
          - Otherwise → an error string.
        """
        # Normalize curly quotes and common words
        s = s.replace('“', '"').replace('”', '"').lower()
        s = re.sub(r'\bft\b', "'", s)
        s = re.sub(r'\bin\b', '"', s)

        # Extract all “measure” tokens
        toks = LineUtils.MEASURE_RE.findall(s)
        if not toks:
            return "No measures found in %r" % s

        # If only one token, return its inch value
        if len(toks) == 1:
            return LineUtils.parse_measure(toks[0])

        # Otherwise, take the first two as draw & real
        draw_tok, real_tok = toks[0], toks[1]

        din = LineUtils.parse_measure(draw_tok)
        if isinstance(din, str):
            return din  # error message

        rin = LineUtils.parse_measure(real_tok)
        if isinstance(rin, str):
            return rin  # error message

        if din == 0:
            return "Drawing measure is zero in %r" % s

        return rin / din

    @staticmethod
    def read_xlsx(file_path, sheetname, filter_word=None):
        """
        Reads all data from the specified sheet in an .xlsx file, returning a list of rows,
        where each row is a list of cell‐values (strings or None). Blank cells become None.
        Any row that is entirely empty—or contains the exact filter_word in any cell—is dropped.
        Any column that is entirely empty (after row‐pruning) is also dropped, so the returned
        grid is rectangular. Errors are printed (e.g. file not found, sheet not found), and
        an empty list is returned on failure.
    
        Args:
            file_path (str): Path to the .xlsx file.
            sheetname (str): Name of the sheet to read.
            filter_word (str or None): If provided, any row containing a cell == filter_word
                                       will be skipped entirely. Default is None (no extra filtering).
    
        Returns:
            List[List[str or None]]: 2D list of cell values, with no entirely‐blank rows or columns,
                                     and with rows containing filter_word removed. Returns [] on errors.
        """
        data = []
        try:
            z = zipfile.ZipFile(file_path, 'r')
        except Exception as e:
            print("Error: cannot open '%s' as a ZIP archive: %s" % (file_path, e))
            return data
    
        # XML namespace constants
        NS_SHEET = '{http://schemas.openxmlformats.org/spreadsheetml/2006/main}'
        NS_REL   = {'ns': 'http://schemas.openxmlformats.org/package/2006/relationships'}
    
        # 1) Find the path to the requested sheet inside the XLSX
        sheet_path = None
        try:
            with z.open('xl/workbook.xml') as wb_file:
                wb_tree = ET.parse(wb_file)
                sheets = wb_tree.findall('.//%ssheet' % NS_SHEET)
                for sheet in sheets:
                    if sheet.get('name') == sheetname:
                        sheet_id = sheet.get(
                            '{http://schemas.openxmlformats.org/officeDocument/2006/relationships}id'
                        )
                        if not sheet_id:
                            print("Error: sheet '%s' has no relationship ID." % sheetname)
                            return data
    
                        try:
                            with z.open('xl/_rels/workbook.xml.rels') as rels_file:
                                rels_tree = ET.parse(rels_file)
                                relationships = rels_tree.findall('.//ns:Relationship', NS_REL)
                                for rel in relationships:
                                    if rel.get('Id') == sheet_id:
                                        target = rel.get('Target')
                                        if not target:
                                            continue
                                        sheet_path = 'xl/' + target.replace('\\', '/')
                                        break
                        except Exception as e_rels:
                            print("Error: cannot read relationships for workbook: %s" % e_rels)
                            return data
    
                        break
    
            if not sheet_path:
                print("Error: sheet named '%s' not found in workbook." % sheetname)
                return data
    
        except Exception as e_wb:
            print("Error: failed to parse 'xl/workbook.xml': %s" % e_wb)
            return data
    
        # 2) Read shared strings (if present)
        shared_strings = []
        try:
            with z.open('xl/sharedStrings.xml') as ss_file:
                ss_tree = ET.parse(ss_file)
                for t in ss_tree.findall('.//%st' % NS_SHEET):
                    shared_strings.append(t.text or '')
        except KeyError:
            # If sharedStrings.xml doesn’t exist, proceed with empty list
            shared_strings = []
        except Exception as e_ss:
            print("Warning: failed to read sharedStrings.xml: %s" % e_ss)
            shared_strings = []
    
        # 3) Parse the sheet XML and collect raw rows
        try:
            with z.open(sheet_path) as sheet_file:
                sheet_tree = ET.parse(sheet_file)
                for row in sheet_tree.findall('.//%srow' % NS_SHEET):
                    row_data = []
                    for c in row.findall('%sc' % NS_SHEET):
                        v = c.find('%sv' % NS_SHEET)
                        if v is None or v.text is None:
                            # no <v> or empty <v> → treat as None
                            row_data.append(None)
                        else:
                            val = v.text
                            if c.get('t') == 's':
                                try:
                                    idx = int(val)
                                    if 0 <= idx < len(shared_strings):
                                        val = shared_strings[idx]
                                    else:
                                        print("Warning: sharedStrings index %d out of range" % idx)
                                        val = None
                                except Exception:
                                    print("Warning: invalid sharedStrings index '%s'" % val)
                                    val = None
                            row_data.append(val)
                    data.append(row_data)
    
        except KeyError:
            print("Error: cannot open sheet file '%s' in archive." % sheet_path)
            return []
        except Exception as e_sheet:
            print("Error: failed to parse sheet XML '%s': %s" % (sheet_path, e_sheet))
            return []
    
        # If we got no rows at all, return empty
        if not data:
            return []
    
        # === 4) Remove any row that is 100% empty, or contains filter_word ===
        def is_row_empty(row):
            # A row is “empty” if every cell is either None or empty-string
            for cell in row:
                if cell not in (None, ''):
                    return False
            return True
    
        pruned_rows = []
        for row in data:
            # 4a) Skip if entire row is empty
            if is_row_empty(row):
                continue
    
            # 4b) Skip if filter_word is provided and matches any cell exactly
            if filter_word is not None:
                skip_due_to_filter = False
                for cell in row:
                    # Compare only non-None cells
                    if cell == filter_word:
                        skip_due_to_filter = True
                        break
                if skip_due_to_filter:
                    continue
    
            # Otherwise, keep the row
            pruned_rows.append(row)
    
        if not pruned_rows:
            # All rows were empty or filtered out → nothing to return
            return []
    
        # === 5) Pad all rows to the same length with None (so columns line up) ===
        max_cols = max(len(r) for r in pruned_rows)
        for r in pruned_rows:
            if len(r) < max_cols:
                r.extend([None] * (max_cols - len(r)))
    
        # === 6) Identify entirely‐empty columns (after row pruning) ===
        keep_column = [False] * max_cols
        for col_idx in range(max_cols):
            for row in pruned_rows:
                cell = row[col_idx]
                if cell not in (None, ''):
                    keep_column[col_idx] = True
                    break
    
        # If no columns remain, return empty
        if not any(keep_column):
            return []
    
        # === 7) Build the final “clean” grid, keeping only non‐empty columns ===
        cleaned_data = []
        for row in pruned_rows:
            new_row = [row[j] for j in range(max_cols) if keep_column[j]]
            cleaned_data.append(new_row)
    
        return cleaned_data
    
    @staticmethod
    def generate_wiki(target_cls):
        """
        Generates a Markdown wiki of every public method in the given class.
        """

        spacer = "----------------------------------"
        title = "     {0} API     ".format(target_cls.__name__)
        lines = [spacer, title, spacer, "\n"]

        # collect and sort public methods
        methods = inspect.getmembers(target_cls, inspect.isfunction)
        count = 0
        for name, func in methods:
            #internal method
            if name.startswith("_"):
                continue
                
            count += 1
            idx = "{:02d}.".format(count)

            # build signature
            try:
                argspec = inspect.getargspec(func)
                args = argspec.args or []
                sig = "{name}({args})".format(
                    name=name,
                    args=", ".join(args)
                )
            except TypeError:
                # built-ins or callables without retrievable signature
                sig = name + "()"

            # clean and indent docstring
            doc = inspect.getdoc(func) or ""
            doc_lines = []
            for dl in doc.splitlines():
                doc_lines.append("   " + dl)

            # append enumeration, signature, and doc
            lines.append("{idx} `{sig}`".format(idx=idx, sig=sig))
            lines.append("")
            lines.extend(doc_lines)
            lines.append("")

        return "\n".join(lines)
# ---------- end ghpython_script_2 ----------
data_2 = Data(ghpython_script.Renumbered_Data)
lineutils = Data(ghpython_script_2.LineUtils)
ghpython_script_3 = GhPythonScript(LineUtils=lineutils, LineUtils_2=lineutils)  # -> out, a
# ---------- ghpython_script_3: Python ----------
import Rhino.Geometry as rg

a = LineUtils.generate_wiki(LineUtils)
# ---------- end ghpython_script_3 ----------
panel_2 = Panel(ghpython_script_3.a)
data_3 = Data(Slider(1, range=0..10))
data_4 = Data(data_2)
ghpython_script_4 = GhPythonScript(LineUtils=lineutils, polylines=data_4, spacing=data_3, perpanel=Toggle(False))  # -> out, adjusted, vectest, f, e, d, c, b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; inputs polylines: tree of Polyline, perpanel: Boolean
# ---------- ghpython_script_4: Python ----------
import Rhino.Geometry as rg
import Grasshopper as gh
import math
from collections import defaultdict
import itertools
import System

GLOBAL_TOL = 0.01
defaultpath = gh.Kernel.Data.GH_Path(0)
unitX = rg.Vector3d(1, 0, 0)
unitY = rg.Vector3d(0, 1, 0)

ghenv.Component.Message = "v0.51 spacing"

class PolyPoint(object):
    def __init__(self, x, y, z=0.0):
        self.pt = rg.Point3d(x, y, z)

    def move(self, vector):
        xform = rg.Transform.Translation(vector)
        self.pt.Transform(xform)

    @property
    def location(self):
        return self.pt

class PolySegment(object):
    def __init__(self, start_point, end_point, polypath = None):
        self.start = start_point
        self.end = end_point
        self.polypath = polypath
        self.lookupid = -1               # default lookup index
        self.lookupidflip = -1
        self.lookupidraw = -1
        self.lookup_geometry = None      # actual flipped lookup line geometry
        self.lookup_geometry_flip = None
        self.lookup_geometry_raw = None
        self.prevturn = "Unset"
        self.nextturn = "Straight"
        self.selfturn = "Straight"
        self.startchain = []             # chain of start parameters
        self.endchain = []               # chain of end parameters
        self.nextturnchain = []
        self.prevturnchain = []
        self.scorechain = []
        self.sortchain = [] #mainattempt
        self.sortchainflip = []
        self.sortchainraw = []
        self.polydirflagged = False
        self.bundleindex = -1 #default

    @property
    def geometry(self):
        return rg.Line(self.start.pt, self.end.pt)

    @property
    def startpar(self):
        if not self.lookup_geometry:
            return -1.0
        # raw parameter on infinite line
        return round(self.lookup_geometry.ClosestParameter(self.geometry.From), 3)

    @property
    def endpar(self):
        if not self.lookup_geometry:
            return -1.0
        # raw parameter on infinite line
        return round(self.lookup_geometry.ClosestParameter(self.geometry.To), 3)

    @property
    def endparraw(self):
        if not self.lookup_geometry_raw:
            return -1.0
        # raw parameter on infinite line
        return round(self.lookup_geometry_raw.ClosestParameter(self.geometry.To), 3)

    def move(self, vector):
        self.start.move(vector)
        self.end.move(vector)

    def set_id(self, id):
        self.lookupid = id

    def set_lookup_geometry(self, line):
        # store a copy of the flipped lookup line
        self.lookup_geometry = rg.Line(line.From, line.To)

    def set_id_raw(self, id):
        self.lookupidraw = id

    def set_lookup_geometry_raw(self, line):
        # store a copy of the flipped lookup line
        self.lookup_geometry_raw = rg.Line(line.From, line.To)

    """
    unset means straight
    left -> 0
    unset -> 1
    right -> 2
    """
    @property
    def groupindexnext(self):
        if self.nextturn == "Left":
            return 0
        elif self.nextturn == "Straight":
            return 1
        elif self.nextturn == "Right":
            return 2

    @property
    def dirmatch(self):
        selfdir = self.geometry.Direction
        selfdir.Unitize()
        lkpdir = self.lookup_geometry.Direction
        lkpdir.Unitize()
        dot = selfdir * lkpdir
        
        return dot > 0.5

    @property
    def sort_idx(self):
        if perpanel:
            #divide grouping by paths
            pathoffset = self.polypath.Indices[0]*10
        else:
            pathoffset = 0
        
        gi = self.groupindexnext
        
        calcpar = 0.0
        
        if gi == 2:
            calcpar = 1 - self.endpar
        else:
            calcpar = self.endpar
        
        finpar = calcpar + gi 
        
        #if not self.dirmatch:
        if False:
            finpar = 1 - finpar
        
        return finpar + pathoffset #pathoffset will prevernt weaving of different panels

    @property
    def sort_idx_raw(self):
        gi = self.groupindexnext
        calcpar = 0.0
        
        if gi == 2:
            calcpar = 1 - self.endparraw
        else:
            calcpar = self.endparraw
        
        finpar = calcpar + gi 
        
        return finpar

class Polyline(object):
    def __init__(self, rawpoints, ghpath=defaultpath, ghidx = -1):
        self.rawpoints = list(rawpoints)
        self.ghpath = ghpath
        self.ghidx = ghidx
        self._build()

    def _build(self):
        unique = []
        for p in self.rawpoints:
            if not unique or unique[-1].DistanceTo(p) > GLOBAL_TOL:
                unique.append(rg.Point3d(p.X, p.Y, p.Z))

        filtered = []
        for i in range(len(unique)):
            if i == 0 or i == len(unique) - 1:
                filtered.append(unique[i])
            else:
                p0, p1, p2 = unique[i-1], unique[i], unique[i+1]
                v1 = rg.Vector3d(p1.X-p0.X, p1.Y-p0.Y, p1.Z-p0.Z)
                v2 = rg.Vector3d(p2.X-p1.X, p2.Y-p1.Y, p2.Z-p1.Z)
                if rg.Vector3d.CrossProduct(v1, v2).Length > GLOBAL_TOL:
                    filtered.append(p1)

        self.points = [PolyPoint(p.X, p.Y, p.Z) for p in filtered]
        self.segments = []
        for i in range(len(self.points) - 1):
            self.segments.append(PolySegment(self.points[i], self.points[i+1], self.ghpath))

    def move_segment(self, index, vector):
        if index < 0 or index >= len(self.segments):
            print "IndexError: Segment index out of range."
            return
        self.segments[index].move(vector)

    def move_segments(self, indices, vectors):
        if len(indices) != len(vectors):
            print "ValueError: indices and vectors must be the same length."
            return
        for idx, vec in zip(indices, vectors):
            self.move_segment(idx, vec)

    def assign_ids(self, candidates):
        for seg in self.segments:
            best_idx = find_best_candidate(seg.geometry, candidates)
            seg.set_id(best_idx)
            seg.set_lookup_geometry(candidates[best_idx])

    def assign_ids_raw(self, candidates):
        for seg in self.segments:
            best_idx = find_best_candidate(seg.geometry, candidates)
            seg.set_id_raw(best_idx)
            seg.set_lookup_geometry_raw(candidates[best_idx])

    def finalize_segments(self):
        count = len(self.segments)
        for i, seg in enumerate(self.segments):
            # previous turn
            if i > 0:
                prev_dir = self.segments[i-1].geometry.Direction
                prev_dir.Unitize()
                cur_dir = seg.geometry.Direction
                cur_dir.Unitize()
                cross = rg.Vector3d.CrossProduct(prev_dir, cur_dir)
                if cross.Z > 0:
                    seg.prevturn = "Left"
                    seg.selfturn = "Left"
                else:
                    seg.prevturn = "Right"
                    seg.selfturn = "Right"
                    
                    
                
            # next turn
            if i < count - 1:
                next_dir = self.segments[i+1].geometry.Direction
                next_dir.Unitize()
                cur_dir = seg.geometry.Direction
                cur_dir.Unitize()
                cross = rg.Vector3d.CrossProduct(cur_dir, next_dir)
                if cross.Z > 0:
                    seg.nextturn = "Left"
                else:
                    seg.nextturn = "Right"
        
        verflag = False
        cur_dir = seg.geometry.Direction
        cur_dir.Unitize()
        
        if cur_dir * unitY > 0.5:
            verflag = True
        
        for i, seg in enumerate(self.segments):
            seg.nextturnchain = []
            for k in range(2): # this segment + next 1
                idx = i + k # -1 #-1 experimental edit
                if idx < count:
                    seg.nextturnchain.append(self.segments[idx].nextturn)
                else:
                    seg.nextturnchain.append("Unset")
        
        for i, seg in enumerate(self.segments):
            seg.scorechain = []
            for j in range(5):  # this segment + next 4
                idx = i + j
                
                if idx < count:
                    #trn = self.segments[idx].nextturn
                    trn = self.segments[idx].selfturn
                    glen = round(self.segments[idx].geometry.Length, 3)
                    if trn == "Left":
                        seg.scorechain.append(-glen)
                        #seg.scorechain.append(glen)
                    else:
                        seg.scorechain.append(glen)
                else:
                    seg.scorechain.append(999999)

        # build startchain and endchain for each segment
        for i, seg in enumerate(self.segments):
            seg.endchain = []
            for j in range(5):  # this segment + next 4
                idx = i + j
                
                if idx < count:
                    ioffset = self.segments[idx].groupindexnext
                    idxpar = self.segments[idx].endpar
                    bracketpar = -1
                    if ioffset in [0, 1, 2]:
                        bracketpar = 0
                    if ioffset == 3:
                        bracketpar = 1
                    if ioffset in [4, 5, 6]:
                        bracketpar = 2
                    seg.endchain.append(bracketpar + idxpar)
                else:
                    seg.endchain.append(0.0)

        for i, seg in enumerate(self.segments):
            seg.sortchain = []
            seg.sortchainflip = []
            seg.sortchainraw = []
            for j in range(5):  #5 for debugging, normally could be more
                idx = i + j
                
                if idx < count:
                    soridx = self.segments[idx].sort_idx
                    seg.sortchain.append(soridx)
                    seg.sortchainflip.append((soridx//1) + (1-soridx%1)) #flip the actual parameter offset but retain direction bias
                    seg.sortchainraw.append(self.segments[idx].sort_idx_raw)
                else:
                    seg.sortchain.append(5)
                    seg.sortchainflip.append(5) #maybe 5 need to test
                    seg.sortchainraw.append(5)

        for seg in self.segments:
            if self.dirflagged:
                seg.polydirflagged = True

    @property
    def polyline_geometry(self):
        pts = [pt.location for pt in self.points]
        return rg.Polyline(pts)
    
    @property
    def dirflagged(self):
        for sgm in self.segments:
            if sgm.dirmatch == False:
                return True
        return False

safeext = spacing*100

class DoubleSegment(object):
    def __init__(self, first, final):
        self.first = first 
        self.final = final
    
    @property
    def id(self):
        return self.first.lookupid
    
    @property
    def p1(self):
        #return self.first.startpar
        return self.lookup.ClosestParameter(self.geometry.From)
    
    @property
    def p2(self):
        #return self.first.endpar
        return self.lookup.ClosestParameter(self.geometry.To)
    
    @property
    def domain(self):
        return rg.Interval(*sorted([self.p1, self.p2]))
    
    @property
    def geometry(self):
        geo = self.final.geometry
        pts = sorted([geo.From, geo.To], key = lambda p: (p.X, p.Y))
        return rg.Line(*pts)
    
    @property
    def lookup(self):
        lkpg = self.first.lookup_geometry
        lkpline = rg.Line(lkpg.From, lkpg.To)
        #lkpline.Extend(safeext, safeext) #need to check if needed
        return lkpline


class DoublePoly(object):
    def __init__(self, polyfirstpass, polyfinalpass):
        self.firstpass = polyfirstpass
        self.finalpass = polyfinalpass
    
    @property
    def segmentpairs(self):
        pairs = zip(self.firstpass.segments, self.finalpass.segments)
        return [DoubleSegment(*pair) for pair in pairs]


def find_best_candidate(checksegment, candidates):
    #direction prep helps with tolerance, grid is also prepped
    segment = rg.Line(*sorted([checksegment.From, checksegment.To], key=lambda point: (point.X, point.Y)))
    # Precompute angle buckets for candidates
    angle_buckets = {}
    for i, cand in enumerate(candidates):
        dir_vec = cand.Direction
        dir_vec.Unitize()
        key = round(abs(dir_vec * unitY), 2)
        #key = LineUtils.encode(dir_vec)
        if key not in angle_buckets:
            angle_buckets[key] = []
        angle_buckets[key].append(i)
    
    #print angle_buckets.keys()
    
    seg_dir = segment.Direction
    seg_dir.Unitize()
    key = round(abs(seg_dir * unitY), 2)#LineUtils.encode(seg_dir, 2)

    bucket = angle_buckets.get(key, [])

    best_idx = -1
    best_dist = float('inf')
    
    mid = segment.PointAt(0.5)
    
    for i in bucket:
        dist = candidates[i].DistanceTo(mid, True)
        if dist < best_dist:
            best_dist = dist
            best_idx = i

    return best_idx

def computeindices(n):
    # raw pairs
    if n <= 2:
        return []
    else:
        center = n // 2
        if n % 2 == 0:
            centers = {center - 1, center}
            left = [i for i in range(n - 1) if i + 1 < center]
        else:
            centers = {center}
            left = [i for i in range(n - 1) if i + 1 <= center]
        right = [i for i in range(n - 1) if i >= center]
        left.sort(reverse=True)
        indexpairs = []
        for l, r in zip(left, right):
            indexpairs += [[l, l + 1], [r + 1, r]]
    
    #extend each pair toward the centers
    extended_indexpairs = []
    min_c = min(centers)
    for i, j in indexpairs:
        path = [i, j]
        while path[-1] not in centers:
            step = 1 if path[-1] < min_c else -1
            path.append(path[-1] + step)
        extended_indexpairs.append(path)
    
    return extended_indexpairs

def solver(polylines, solveparts = False):
    polys = []
    rawlinelookup = []
    segments_list = []
    
    for path in polylines.Paths:
        polysatpath = polylines.Branch(path)
        for pidx, p in enumerate(polysatpath):
            polyobj = Polyline(list(p), path, pidx)
            polysegs = polyobj.segments
            for polyseg in polysegs:
                rawlinelookup.append(polyseg.geometry)
                segments_list.append(polyseg)
            polys.append(polyobj)
    
    linelookup = LineUtils.process_lines(rawlinelookup, 0.01)
    linelookupraw = LineUtils.process_lines(rawlinelookup, 0.01, True)
    
    vectors = [[] for _ in linelookup]
    weight = [[] for _ in linelookup]
    
    for poly in polys:
        poly.assign_ids(linelookup)
        
        for seg in poly.segments:
            seggeo = seg.geometry
            idx = find_best_candidate(seggeo, linelookup)
            weight[idx].append(seggeo.Length)
            segvec = seggeo.Direction
            segvec.Unitize()
            vectors[idx].append(segvec)
    
    dominant_vectors = []
    
    for vec_list, w_list in zip(vectors, weight):
        #print vec_list
        ref = rg.Vector3d(vec_list[0])
        ref.Unitize()
    
        pos_w = 0.0
        neg_w = 0.0
        for v, w in zip(vec_list, w_list):
            if v * ref >= 0:  # dot product ≥ 0 => same hemisphere
                pos_w += w
            else:
                neg_w += w
    
        if pos_w >= neg_w:
            dominant = rg.Vector3d(ref)
        else:
            dominant = rg.Vector3d(-ref.X, -ref.Y, -ref.Z)
    
        dominant_vectors.append(dominant)
    
    #adjust lines to match dominant vector
    for line, vec in zip(linelookup, dominant_vectors):
        linedir = line.Direction
        linedir.Unitize()
        dotcheck = linedir * vec 
        if dotcheck < 0:
            pass
            line.Flip()
    
    flippedlookup = []
    for l in linelookup:
        flipline = rg.Line(l.To, l.From)
        flippedlookup.append(flipline)
    
    if solveparts:
        linelookup, linelookupraw = linelookupraw, linelookup
    
    for poly in polys:
        poly.assign_ids(linelookup) #now with flips, same id
        #poly.assign_ids(linelookupraw)
        poly.finalize_segments()
        poly.assign_ids_raw(linelookupraw)
    
    groups = defaultdict(list)
    for seg in segments_list:
        groups[seg.lookupid].append(seg)
    
    for lid, group in groups.items():
        if lid < 0 or not group:
            continue
    
        d = linelookup[lid].Direction
        d.Unitize()
        
        ordered = group
        ordered.sort(key=lambda s: s.sortchain)
    
        groups = [list(g) for _, g in itertools.groupby(ordered, lambda s: s.dirmatch)]
        groups.reverse()
    
        reordered = list(itertools.chain.from_iterable(groups))
        
        groups2 = [list(g) for _, g in itertools.groupby(reordered, lambda s: s.polydirflagged)]
        
        ordered = reordered
    
        count = len(ordered)
        center = (count - 1) / 2.0
        center_global = center
        
        raw_offsets = [(i - center_global) * spacing for i in range(count)]
        # map each segment to its raw offset
        seg_to_offset = {seg: raw_offsets[i] for i, seg in enumerate(ordered)}
    
        perp = rg.Vector3d(d.Y, -d.X, 0)
        
        if solveparts:
            #print "here"
            for idx, seg in enumerate(ordered):
                offset = (idx - center) * spacing
                move_vec = rg.Vector3d(perp)
                move_vec *= offset
                seg.move(move_vec)
                seg.bundleindex = idx
    
        else:
            #print "not here"
            #for each subgroup in groups2, compute its mean offset…
            for bundle_index, subgroup in enumerate(groups2):
                mean_off = sum(seg_to_offset[seg] for seg in subgroup) / len(subgroup)
            
                # 3) move every segment in this subgroup to that subgroup center
                for seg in subgroup:
                    move_vec = rg.Vector3d(perp)
                    move_vec *= mean_off
                    seg.move(move_vec)
                    seg.bundleindex = bundle_index
    
    secondpasscandidates = []
    firstpasses = []
    for poly in polys:
        if poly.dirflagged:
            secondpasscandidates.append(poly)
        else:
            firstpasses.append(poly)
    
    
    rebuiltree = gh.DataTree[System.Object]()
    
    for path in polylines.Paths:
        polysatpath = polylines.Branch(path)
        if len(polysatpath) < 1:
            rebuiltree.AddRange([], path)
    
    for poly in polys:
        path = poly.ghpath
        rebuiltree.Add(poly.polyline_geometry, path)
    
    return rebuiltree, polys

rebuiltree, polys = solver(polylines, False)
testpass, polys2 = solver(rebuiltree, True)

doublepolys = [DoublePoly(poly, poly2) for poly, poly2 in zip(polys, polys2)]

dsegments = []
for doublepoly in doublepolys:
    for dseg in doublepoly.segmentpairs:
        dsegments.append(dseg)

bundles = defaultdict(list)

for dseg in dsegments:
    bundles[dseg.id].append(dseg)

for bindx, bundle in bundles.items():
    bundlelen = len(bundle)
    indexlists = computeindices(bundlelen)
    if indexlists:
        for indexlist in indexlists:
            needle = bundle[indexlist[0]]
            haystack = indexlist[1:]
            lastcandidate = None
            for h in haystack:
                hh = bundle[h]
                check = LineUtils.domains_overlap(needle.domain, hh.domain, tol=-0.0005) #negative tol shrinks, so touching wouldnt overlap
                if not check:
                    if not lastcandidate:
                        pass
                    else:
                        pass
                        movevec = LineUtils.vector_between_lines(needle.geometry, lastcandidate)
                        #print movevec
                        #movevec = rg.Vector3d(0, 0, 1)
                        #needle.final.move(movevec)
                else:
                    #print needle.domain, hh.domain
                    #break
                    lastcandidate = hh.geometry
                

adjusted = []
for dseg in dsegments:
    adjusted.append(dseg.final.geometry)

#LineUtils.domains_overlap(d1, d2, tol=-0.0005) negative tol shrinks, so touching wouldnt overlap

#c = []
b = []
d = []
e = []
f = []
tbundle = bundles[6] #50 #6 #23
c = tbundle[0].lookup

dd = tbundle[0].lookup.Direction
dd.Unitize()
perp2 = rg.Vector3d(dd.Y, -dd.X, 0)
perpline = rg.Line(rg.Point3d(0, 0, 0), perp2)

tbundle.sort(key = lambda t: perpline.ClosestParameter(t.geometry.From))

bundle = tbundle

bundlelen = len(bundle)
indexlists = computeindices(bundlelen)
bundlelookup = [[bndl.domain] for bndl in bundle]
print indexlists
if indexlists:
    for indexlist in indexlists:
        needle = bundle[indexlist[0]]
        haystack = indexlist[1:]
        lastcandidate = None
        lastindx = None
        for h in haystack:
            hh = bundle[h]
            #function triggers on overlap, so no overlap means I can fit
            check =  not any([LineUtils.domains_overlap(needle.domain, hhh, tol = - 0.0005) for hhh in bundlelookup[h]])#tol=-0.0005) #negative tol shrinks, so touching wouldnt overlap

            if check:
                lastindx = h
                lastcandidate = hh.geometry
            else:
                break
        #print h, indexlist, check, bool(lastcandidate), bundlelookup[h]
#        if lastcandidate:
#            movevec = LineUtils.vector_between_lines(needle.geometry, lastcandidate)
#            print movevec
#            needle.final.move(movevec)
#            #print indexlist[0]
#            #bundlelookup[indexlist[0]] = [rg.Interval(-100.0, -99.0)] #placeholder for checks
#            bundlelookup[indexlist[0]].pop()
#            #bundlelookup[h].append(needle.domain)
#            bundlelookup[lastindx].append(needle.domain)
#            #break
        


#print any([LineUtils.domains_overlap(needle.domain, hhh, tol = - 0.0005) for hhh in []])

#for jidx, jk in enumerate(bundlelookup):
#    pass
#    print jidx, " ".join([" dom "+str(ji)+ " start : " + str(round(jjk.T0, 5)) + " end : " + str(round(jjk.T1, 5)) for ji, jjk in enumerate(jk)]) #jk

for ff, tseg in enumerate(tbundle):
    b.append(tseg.final.geometry)
    d.append(round(tseg.p1, 5))
    e.append(round(tseg.p2, 5))
    f.append(ff)
#
#geo1 = tbundle[0].geometry
#geo2 = tbundle[5].geometry
#vectest = LineUtils.vector_between_lines(geo1, geo2)

#n = 22#len(tbundle)



#print n
#print indexpairs
#print extended_indexpairs

## now iterate in that order
#for i, j in bundlesearchlookup:
#    # do something with bundle[i], bundle[j]
#    print(bundle[i], bundle[j])
# ---------- end ghpython_script_4 ----------
data_5 = Data(ghpython_script_4.rebuiltree)
ghpython_script_5 = GhPythonScript(polys=ghpython_script_4.polys2)  # -> out, simplify(geometry), geometry2, path, ghidx, segments, dirflagged
# ---------- ghpython_script_5: Python ----------
import Rhino.Geometry as rg

#geometry = list(polys.polyline_geometry)[:-1]
path = polys.ghpath
segments = polys.segments
geometry = polys.polyline_geometry
geometry2 = list(polys.polyline_geometry)[:-1]
ghidx = polys.ghidx
dirflagged = polys.dirflagged
# ---------- end ghpython_script_5 ----------
data_6 = Data(ghpython_script_4.doublepolys)
ghpython_script_6 = GhPythonScript(segments=ghpython_script_5.segments)  # -> out, geometry, dirmatch, polypath, bundleindex
# ---------- ghpython_script_6: Python ----------
import Rhino.Geometry as rg

geometry = segments.geometry
dirmatch = segments.dirmatch
polypath = segments.polypath
bundleindex = segments.bundleindex
# ---------- end ghpython_script_6 ----------
polyline = PolyLine(Vertices=ghpython_script_5.geometry2, Closed=False)

ghpython_script_7 = GhPythonScript(doublepolys=data_6)  # -> out, simplify(geometry), simplify(idx), simplify(lookup_geometry)
# ---------- ghpython_script_7: Python ----------
import Rhino.Geometry as rg

geometry = []
idx = []
lookup_geometry = []

for segfirst, segfinal in zip(doublepolys.firstpass.segments, doublepolys.finalpass.segments):
    geometry.append(segfinal.geometry)
    print dir(segfinal)
    idx.append(segfirst.lookupid)
    lookup_geometry.append(segfirst.lookup_geometry)
#break
# ---------- end ghpython_script_7 ----------
python_3 = GhPythonScript(objects=flatten(ghpython_script_7.geometry), indices=flatten(ghpython_script_7.idx))  # -> out, out_objects; inputs objects: list, indices: list of Int32
# ---------- python_3: Python ----------
import Grasshopper as gh
import Rhino.Geometry as rg

tree = gh.DataTree[object]()

for i, obj in enumerate(objects):
    path_index = indices[i]
    path = gh.Kernel.Data.GH_Path(path_index)
    tree.Add(obj, path)

out_objects = tree
# ---------- end python_3 ----------
crv_4 = Curve(python_3.out_objects)
lng = ListLength(List=crv_4)
equals = Equality(FirstNumber=lng, SecondNumber="1")  # -> Equality, Inequality
cull = CullPattern(List=crv_4, CullPattern=equals.Inequality)
crv_5 = Curve(cull)

clean = CleanTree(RemoveNulls=True, RemoveInvalid=True, RemoveEmpty=invert(False), Tree=crv_5)
number_slider = Slider(19.1, range=0..24)
rod_step = Slider(33, range=0..100)
rod_step_2 = Slider(14, range=0..100)
python_4 = GhPythonScript(
    LINES=clean,
    ROUNDING=Slider(10, range=0..30),
    MIN_DISTANCE_CORNER=Slider(12, range=0..100),
    MAX_DISTANCE_CORNER=Slider(42, range=0..100),
    SUSPENSION_STEP=Slider(108, range=0..150),
    MAX_DIST_B_PT_CENTER=Slider(12, range=0..24),
    THRESHOLD_FILTER=number_slider,
    RODS_STEP=rod_step,
    DISTANCE_JOINING_START_END_LINES=rod_step_2)  # -> out, start_line, end_line, start_lonely, end_lonely, cut_line, safe_support_lines, orphaned_points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; inputs LINES: list of Line
# ---------- python_4: Python ----------
import Rhino.Geometry as rg
import Grasshopper as gh
from collections import defaultdict
import math

ghenv.Component.Message = "v0.06 suspension"

GLOBAL_TOL = 0.01

def sort_lines_perpendicular(lines, reference_direction):
    """
    Sort lines perpendicular to the reference direction.
    
    Args:
        lines: List of lines to sort
        reference_direction: Reference direction vector (Vector3d)
    
    Returns:
        Sorted list of lines
    """
    # find the vector perpendicular to reference_direction
    perp_vector = rg.Vector3d(-reference_direction.Y, reference_direction.X, 0)
    perp_vector.Unitize()

    # sort by the projection of the point line.From onto this vector
    def projection_key(line):
        pt = line.From
        vec = rg.Vector3d(pt.X, pt.Y, pt.Z)
        return vec * perp_vector  # scalar projection

    sorted_lines = sorted(lines, key=projection_key)
    return sorted_lines


def line_same_direction(lines):
    """
    Align all lines in the same direction and sort them perpendicularly.
    
    Args:
        lines: List of lines to align
    
    Returns:
        Tuple of (aligned lines, reference direction)
    """
    if not lines:
        return
    
    reference_line = lines[0]
    reference_direction = rg.Vector3d(reference_line.Direction)
    reference_direction.Unitize()
    
    aligned_lines = []
    
    for line in lines:
        direction = line.Direction
        direction.Unitize()
        if reference_direction * direction < 0:
            flipped_lene = rg.Line(line.To, line.From)
            aligned_lines.append(flipped_lene)
        else:
            aligned_lines.append(line)
    return sort_lines_perpendicular(aligned_lines, reference_direction), reference_direction


def suspension_corners(lines, dir, round, min_val, is_start):
    """
    Generate suspension corner points with rounding and minimum distance consideration.
    
    Args:
        lines: List of lines
        dir: Direction vector
        round: Rounding radius
        min_val: Minimum distance
        is_start: Whether these are start points (True/False)
    
    Returns:
        List of corner points
    """
    pt = []
    for line in lines:
        if is_start:
            min_start_pt = rg.Point3d(line.From)
            min_vector = dir * (round + min_val)
        else:
            min_start_pt = rg.Point3d(line.To)
            min_vector = dir * -1 * (round + min_val)
        min_xform = rg.Transform.Translation(min_vector)
        min_start_pt.Transform(min_xform)
        
        pt.append(min_start_pt)
    return pt


def strict_cluster_points(points, direction, max_distance, is_start=True):
    """
    Group points into clusters based on projection onto the given direction.
    
    Args:
        points: List of points
        direction: Direction for projection
        max_distance: Maximum distance between points in a cluster
        is_start: Whether these are start points
    
    Returns:
        Tuple of (group indices, representative points)
    """
    direction = rg.Vector3d(direction)
    direction.Unitize()
    
    # secure verification
    projections = []
    for idx, pt in enumerate(points):
        vec = rg.Vector3d(pt)
        scalar_proj = vec * direction
        projections.append((idx, scalar_proj))
    
    group_ids = [-1] * len(points)
    current_group = 0
    remaining = set(range(len(points)))
    representative_points = []

    while remaining:
        seed_idx = next(iter(remaining))
        group = [seed_idx]
        group_ids[seed_idx] = current_group
        remaining.remove(seed_idx)

        changed = True
        while changed:
            changed = False
            to_add = []
            for idx in remaining:
                if all(abs(projections[idx][1] - projections[gi][1]) <= max_distance for gi in group):
                    to_add.append(idx)
                    group_ids[idx] = current_group
                    changed = True
            for idx in to_add:
                group.append(idx)
                remaining.remove(idx)

        # Select a representative point in the group
        best_idx = max(
            group,
            key=lambda idx: projections[idx][1] if is_start else -projections[idx][1]
        )
        representative_points.append(points[best_idx])
        current_group += 1
    
    return group_ids, representative_points


def project_points_to_group_scalar(points, group_ids, representative_points, direction):
    """
    Project points to their group representative points along the given direction.
    
    Args:
        points: List of points
        group_ids: Group indices for each point
        representative_points: Representative points for groups
        direction: Projection direction
    
    Returns:
        List of aligned points
    """
    aligned_pts = []
    direction = rg.Vector3d(direction)
    direction.Unitize()
    
    rep_projections = []
    for pt in representative_points:
        rep_projections.append(rg.Vector3d(pt) * direction)
    
    for idx, pt in enumerate(points):
        group_id = group_ids[idx]
        target_proj = rep_projections[group_id]
        pt_vec = rg.Vector3d(pt)
        current_proj = pt_vec * direction
        shift_scalar = target_proj - current_proj
        shift_vec = direction * shift_scalar
        new_pt = rg.Point3d(pt)
        new_pt.Transform(rg.Transform.Translation(shift_vec))
        aligned_pts.append(new_pt)

    return aligned_pts


def grouped_polylines_by_index(points, group_indices):
    """
    Create polylines from points based on their group indices.
    
    Args:
        points: List of points
        group_indices: Group indices for points
    
    Returns:
        Tuple of (polylines, lonely points)
    """
    grouped = defaultdict(list)
    
    for pt, group_id in zip(points, group_indices):
        grouped[group_id].append(pt)
    
    polylines = []
    lonely_points = []
    one_point_for_group = []

    for group_id in sorted(grouped.keys()):
        pts = grouped[group_id]
        if len(pts) >= 2:
            one_point_for_group.append(pts[0])
            poly = rg.Polyline(pts)
            polyline_curve = rg.PolylineCurve(poly)
            polylines.append(polyline_curve)
        elif len(pts) == 1:
            lonely_points.append(pts[0])

    return polylines, lonely_points, one_point_for_group


#===============================================================================================================================

def connect_point_pairs(start_points, end_points):
    """
    Create lines between pairs of start and end points.
    
    Args:
        start_points: Start points
        end_points: End points
    
    Returns:
        List of lines
    """
    lines = []
    count = min(len(start_points), len(end_points))  # secure verification
    for i in range(count):
        line = rg.Line(start_points[i], end_points[i])
        lines.append(line)
    return lines


def generate_crossbars_points(lines, max_step, group_points=None):
    """
    Generate points for crossbars with uniform step spacing.
    
    Args:
        lines: List of lines
        max_step: Maximum step between crossbars
        group_points: Optional list of group points to define projection range
    
    Returns:
        List of point lists for crossbars
    """
    ref_dir = rg.Vector3d(lines[0].Direction)
    ref_dir.Unitize()

    # 1. Determine projection range
    if group_points:
        # Use provided group points + line points for projection range
        group_projections = [rg.Vector3d(pt) * ref_dir for pt in group_points]
        # Add all line points to consider line extents
        all_line_pts = [line.From for line in lines] + [line.To for line in lines]
        line_projections = [rg.Vector3d(pt) * ref_dir for pt in all_line_pts]
        # Combine all projections and sort
        all_projections = group_projections + line_projections
        projections = sorted(set(all_projections))  # Remove duplicates and sort
    else:
        # Use all line points for projection range (original behavior)
        all_pts = [line.From for line in lines] + [line.To for line in lines]
        projections = [rg.Vector3d(pt) * ref_dir for pt in all_pts]
        t_min = min(projections)
        t_max = max(projections)
        total_length = t_max - t_min

        if total_length < 1e-6:
            return []

        # Original behavior
        num_sections = int(total_length // max_step) + 1
        actual_step = total_length / num_sections

        crossbar_points = []
        for i in range(num_sections + 1):
            t = t_min + i * actual_step
            pts_on_lines = []
            for line in lines:
                start_proj = rg.Vector3d(line.From) * ref_dir
                end_proj = rg.Vector3d(line.To) * ref_dir

                if start_proj <= t <= end_proj or end_proj <= t <= start_proj:
                    length_proj = end_proj - start_proj
                    if abs(length_proj) < 1e-6:
                        continue
                    ratio = (t - start_proj) / length_proj
                    pt = line.PointAt(ratio)
                    pts_on_lines.append(pt)

            if len(pts_on_lines) >= 1:
                crossbar_points.append(pts_on_lines)

        return crossbar_points

    # 2. For group_points: process each segment between adjacent points
    crossbar_points = []
    
    # Process each segment between adjacent group points
    for i in range(len(projections) - 1):
        segment_start = projections[i]
        segment_end = projections[i + 1]
        segment_length = segment_end - segment_start
        
        if segment_length < 1e-6:
            continue
            
        # Calculate number of steps for this segment
        num_steps = max(1, int(math.ceil(segment_length / max_step)))
        step_size = segment_length / num_steps
        
        # Generate points for this segment
        for j in range(num_steps + 1):
            t = segment_start + j * step_size
            pts_on_lines = []
            
            for line in lines:
                start_proj = rg.Vector3d(line.From) * ref_dir
                end_proj = rg.Vector3d(line.To) * ref_dir

                if start_proj <= t <= end_proj or end_proj <= t <= start_proj:
                    length_proj = end_proj - start_proj
                    if abs(length_proj) < 1e-6:
                        continue
                    ratio = (t - start_proj) / length_proj
                    pt = line.PointAt(ratio)
                    pts_on_lines.append(pt)

            if len(pts_on_lines) >= 1:
                crossbar_points.append(pts_on_lines)

    return crossbar_points


def remove_duplicate_points(points, min_distance=GLOBAL_TOL):
    """
    Remove duplicate points that are closer than min_distance.
    
    Args:
        points: List of points
        min_distance: Minimum distance between points
    
    Returns:
        List of unique points
    """
    if not points:
        return []
    
    unique_points = [points[0]]
    
    for pt in points[1:]:
        is_duplicate = False
        for existing_pt in unique_points:
            if pt.DistanceTo(existing_pt) < min_distance:
                is_duplicate = True
                break
        if not is_duplicate:
            unique_points.append(pt)
    
    return unique_points


def build_segmented_lines(crossbars_points, max_distance):
    """
    Create segmented lines from crossbar points.
    
    Args:
        crossbars_points: Crossbar point lists
        max_distance: Maximum distance between points in a segment
    
    Returns:
        Tuple of (segmented lines, lonely points)
    """
    all_segments = []
    lonely_points = []

    for pt_list in crossbars_points:
        if len(pt_list) < 2:
            lonely_points.extend(pt_list)
            continue

        segment = []
        i = 0
        while i < len(pt_list) - 1:
            pt_a = pt_list[i]
            pt_b = pt_list[i + 1]
            dist = pt_a.DistanceTo(pt_b)

            if dist <= max_distance:
                if not segment:
                    segment.append(pt_a)
                segment.append(pt_b)
            else:
                if len(segment) >= 2:
                    poly = rg.Polyline(segment)
                    all_segments.append(rg.PolylineCurve(poly))
                elif len(segment) == 1:
                    lonely_points.append(segment[0])
                segment = []

            i += 1

        # final segment
        if len(segment) == 1:
            lonely_points.append(segment[0])
        elif len(segment) >= 2:
            poly = rg.Polyline(segment)
            all_segments.append(rg.PolylineCurve(poly))

        # final check
        if i == len(pt_list) - 1 and not any(pt_list[i] == pt for pt in segment):
            lonely_points.append(pt_list[i])

    # remove duplicates from lonely_points
    lonely_points = remove_duplicate_points(lonely_points, GLOBAL_TOL)

    return all_segments, lonely_points


def polylines_to_lines(poly_curves):
    """
    Convert polylines to simple lines.
    
    Args:
        poly_curves: List of polylines
    
    Returns:
        List of lines
    """
    lines = []
    for crv in poly_curves:
        if isinstance(crv, rg.PolylineCurve):
            start_pt = crv.PointAtStart
            end_pt = crv.PointAtEnd
            lines.append(rg.Line(start_pt, end_pt))
        elif isinstance(crv, rg.Polyline):
            if crv.Count >= 2:
                lines.append(rg.Line(crv[0], crv[-1]))
    return lines


def match_support_to_boundary(support_lines, boundary_lines, direction, threshold):
    """
    Match support lines to boundary lines based on projection.
    
    Args:
        support_lines: Support lines
        boundary_lines: Boundary lines
        direction: Direction for projection
        threshold: Distance threshold for matching
    
    Returns:
        List of group indices for support lines
    """
    direction = rg.Vector3d(direction)
    direction.Unitize()

    boundary_projections = []
    for i, line in enumerate(boundary_lines):
        center = line.PointAt(0.5)
        proj = rg.Vector3d(center) * direction
        boundary_projections.append((i, proj))

    support_groups = []
    for line in support_lines:
        center = line.PointAt(0.5)
        proj = rg.Vector3d(center) * direction

        best_idx = -1
        min_dist = float("inf")
        for i, b_proj in boundary_projections:
            dist = abs(proj - b_proj)
            if dist < threshold and dist < min_dist:
                best_idx = i
                min_dist = dist

        support_groups.append(best_idx)  # -1 if no match

    return support_groups


def move_line_to_match_projection(source_line, target_line, direction):
    """
    Move a line to match the projection of the target line.
    
    Args:
        source_line: Source line to move
        target_line: Target line to match
        direction: Projection direction
    
    Returns:
        Moved line
    """
    direction = rg.Vector3d(direction)
    direction.Unitize()

    # Displacement along direction
    source_center = source_line.PointAt(0.5)
    target_center = target_line.PointAt(0.5)
    vec = rg.Vector3d(target_center) - rg.Vector3d(source_center)
    shift = direction * (vec * direction)

    moved_from = source_line.From + shift
    moved_to = source_line.To + shift

    # Construction of a perpendicular vector (XY plane)
    perp = rg.Vector3d(-direction.Y, direction.X, 0)
    perp.Unitize()

    # All points for projection
    points = [
        moved_from,
        moved_to,
        target_line.From,
        target_line.To
    ]

    # Projection onto perp
    projections = [(pt, rg.Vector3d(pt) * perp) for pt in points]
    min_pt = min(projections, key=lambda x: x[1])[0]
    max_pt = max(projections, key=lambda x: x[1])[0]

    # We return the new extended line, which is shifted as before, but stretched along the perpendicular.
    return rg.Line(min_pt, max_pt)


def filter_and_align_lines(boundary_lines, support_lines, support_indices, direction):
    """
    Filter and align lines based on their matching.
    
    Args:
        boundary_lines: Boundary lines
        support_lines: Support lines
        support_indices: Matching indices
        direction: Alignment direction
    
    Returns:
        Tuple of (filtered boundary lines, filtered support lines)
    """
    direction = rg.Vector3d(direction)
    direction.Unitize()

    groups = defaultdict(list)
    boundary_lookup = {}
    used_support_idxs = set()
    used_boundary_idxs = set()

    # 1. Draw boundary lines
    for i, line in enumerate(boundary_lines):
        groups[i].append(("boundary", i, line))
        boundary_lookup[i] = line

    # 2. Add support lines to groups
    for idx, (line, group_idx) in enumerate(zip(support_lines, support_indices)):
        if group_idx != -1:
            groups[group_idx].append(("support", idx, line))

    # 3. Вибір найдовшої лінії у групі
    selected_boundary = []
    selected_support = []

    for group_idx, items in groups.items():
        longest = max(items, key=lambda item: item[2].Length)

        # Позначаємо всі лінії як "використані"
        for item in items:
            if item[0] == "support":
                used_support_idxs.add(item[1])
            else:
                used_boundary_idxs.add(item[1])

        # Додаємо до обраного
        if longest[0] == "support":
            support_idx = longest[1]
            moved = move_line_to_match_projection(longest[2], boundary_lookup[group_idx], direction)
            selected_support.append(moved)
        else:
            selected_boundary.append(longest[2])

    # 4. Додаємо лінії, що не входили до груп
    for i, line in enumerate(support_lines):
        if i not in used_support_idxs:
            selected_support.append(line)

    for i, line in enumerate(boundary_lines):
        if i not in used_boundary_idxs:
            selected_boundary.append(line)

    return selected_boundary, selected_support


def generate_points_on_lines(lines, step):
    """
    Creates points on lines with a given step.
    
    Args:
        lines: List of lines
        step: Step between points
        
    Returns:
        List of points on lines
    """
    points = []
    for line in lines:
        length = line.Length
        num_points = int(length / step)
        
        if num_points == 0:
            # If the line is shorter than a step, add at least the start and end points.
            points.append(line.From)
            points.append(line.To)
            continue
            
        for i in range(num_points + 1):
            t = i / num_points
            point = line.PointAt(t)
            points.append(point)
            
    return points


def merge_lines_by_distance(lines, max_distance, length_tolerance=GLOBAL_TOL):
    """
    Connects lines that are within a specified distance and have the same length.
    
    Algorithm:
    1. Find the midpoints of all lines
    2. Group lines by distance between centers and length
    3. For each group, leave one line centered in the group.
    
    Args:
        lines: List of lines to merge
        max_distance: Maximum distance for merging
        length_tolerance: Permissible difference in line lengths for merging
    
    Returns:
        List of merged lines
    """
    if not lines or len(lines) < 2:
        return lines
    
    # Find the center points and lengths of all lines
    centers_and_lengths = []
    for i, line in enumerate(lines):
        center = line.PointAt(0.5)
        length = line.Length
        centers_and_lengths.append((i, center, length))
    
    # Group lines by distance and length
    groups = []
    used_indices = set()
    
    for i, (idx1, center1, length1) in enumerate(centers_and_lengths):
        if idx1 in used_indices:
            continue
            
        # Creating a new group
        current_group = [idx1]
        used_indices.add(idx1)
        
        # Find all lines within the distance and with the same length
        changed = True
        while changed:
            changed = False
            for j, (idx2, center2, length2) in enumerate(centers_and_lengths):
                if idx2 in used_indices:
                    continue
                    
                # Check if the lengths are the same (with tolerance)
                if abs(length2 - length1) > length_tolerance:
                    continue
                    
                # Check that all lines in the current group are within range
                in_range = True
                for group_idx in current_group:
                    group_center = centers_and_lengths[group_idx][1]
                    if center2.DistanceTo(group_center) > max_distance:
                        in_range = False
                        break
                
                if in_range:
                    current_group.append(idx2)
                    used_indices.add(idx2)
                    changed = True
        
        groups.append(current_group)
    
    # Creating merged lines
    merged_lines = []
    
    for group in groups:
        if len(group) == 1:
            # Find the center of the group
            merged_lines.append(lines[group[0]])
        else:
            # Find the center of the group
            group_centers = [centers_and_lengths[idx][1] for idx in group]
            avg_center = rg.Point3d(0, 0, 0)
            for center in group_centers:
                avg_center += center
            avg_center /= len(group_centers)
            
            # Take the longest line from the group as a basis (although they are all the same length).
            longest_line_idx = max(group, key=lambda idx: lines[idx].Length)
            base_line = lines[longest_line_idx]
            
            # Move the line to the center of the group
            current_center = base_line.PointAt(0.5)
            shift_vector = avg_center - current_center
            
            # Create a new line offset to the center of the group
            new_from = base_line.From + shift_vector
            new_to = base_line.To + shift_vector
            merged_line = rg.Line(new_from, new_to)
            
            merged_lines.append(merged_line)
    
    return merged_lines


#=== S1 ===========================================================================================================================

aligned_lines, reference_direction = line_same_direction(LINES)

start_pt = suspension_corners(
    aligned_lines, 
    reference_direction, 
    ROUNDING,  
    MIN_DISTANCE_CORNER, 
    is_start = True
)
end_pt = suspension_corners(
    aligned_lines, 
    reference_direction, 
    ROUNDING,  
    MIN_DISTANCE_CORNER, 
    is_start = False
)

start_index, start_group_pts = strict_cluster_points(
    start_pt, 
    reference_direction, 
    MAX_DISTANCE_CORNER, 
    is_start=True
)

end_index, end_group_pts = strict_cluster_points(
    end_pt, 
    reference_direction, 
    MAX_DISTANCE_CORNER, 
    is_start=False
)

aligned_start_pts = project_points_to_group_scalar(
    start_pt, 
    start_index, 
    start_group_pts, 
    reference_direction
)

aligned_end_pts = project_points_to_group_scalar(
    end_pt, 
    end_index, 
    end_group_pts, 
    reference_direction
)

# geometry for angles, lines, and points
start_line, start_lonely, start_one_point_for_group = grouped_polylines_by_index(aligned_start_pts, start_index)
end_line, end_lonely, end_one_point_for_group = grouped_polylines_by_index(aligned_end_pts, end_index)

# one point for group
one_point_for_group = start_one_point_for_group + end_one_point_for_group

#=== S2 ============================================================================================================================

# central lines without the part occupying the corners
cut_line = connect_point_pairs(aligned_start_pts, aligned_end_pts)


crossbars_points = generate_crossbars_points(cut_line, SUSPENSION_STEP, one_point_for_group)
#a = [pt for sublist in crossbars_points for pt in sublist]

safe_support_lines, orphaned_points = build_segmented_lines(crossbars_points, MAX_DIST_B_PT_CENTER)


start_line = polylines_to_lines(start_line)
end_line = polylines_to_lines(end_line)
boundary_lines = start_line + end_line

# If the lines are too close to each other (beginning and end), remove one and move the other to the center point.
boundary_lines = merge_lines_by_distance(boundary_lines, DISTANCE_JOINING_START_END_LINES)

safe_support_lines = polylines_to_lines(safe_support_lines)

# indices for grouping by distance between two types
support_indices = match_support_to_boundary(
    safe_support_lines,
    boundary_lines,
    reference_direction,
    THRESHOLD_FILTER
)

# two types of edited lines (those on the left and those in the middle)
boundary_lines_filtered, safe_support_lines_filtered = filter_and_align_lines(
    boundary_lines,
    safe_support_lines,
    support_indices,
    reference_direction
)

#====== OUTPUT =================================================================================================================

unistrut_lines = boundary_lines_filtered + safe_support_lines_filtered
rods_points = generate_points_on_lines(unistrut_lines, RODS_STEP)
single_rods_points = start_lonely + end_lonely + orphaned_points
# ---------- end python_4 ----------
crv_6 = Curve(python_4.unistrut_lines)
pt = Point(python_4.rods_points)
pt_2 = Point(python_4.single_rods_points)

geo = Geometry(clean)
geo_2 = Geometry([pt, crv_6])

panel_3 = Panel(python_4.out)

symsim = SymbolSimple(Style=5, Size=Slider(4, range=0..10), Rotation=0, Colour=ColourSwatch(SwatchColor=RGB(0, 207, 172)))
symsim_2 = SymbolSimple(Style=5, Size=Slider(4, range=0..10), Rotation=0, Colour=ColourSwatch(SwatchColor=RGB(207, 0, 176)))
previewlw = CustomPreviewLineweights(
    Geometry=crv_6,
    Shader=ColourSwatch(SwatchColor=RGB(0, 157, 255)),
    Thickness=Slider(4, range=0..20),
    Absolute=invert(False))
symbol = SymbolDisplay(Location=pt, Display=symsim)
symbol_2 = SymbolDisplay(Location=pt_2, Display=symsim_2)

threshold_filter = Number(number_slider)
line = Line(python_4.safe_support_lines)
int = Integer(python_4.support_indices)
midpt = CurveMiddle(Curve=line)
cir = Circle(Plane=midpt, Radius=threshold_filter)
swatch = ColourSwatch(SwatchColor=RGB(213, 0, 255))
dash = DashPattern(Curve=line, Pattern=Slider(1, range=0..10))  # -> Dashes, Gaps
dash_2 = DashPattern(Curve=cir, Pattern=Slider(4, range=0..10))  # -> Dashes, Gaps
tag = TextTag3D(Location=midpt, Text=int, Size=Slider(6, range=0..10), Colour=swatch, Justification=7)
previewlw_2 = CustomPreviewLineweights(Geometry=[dash_2.Dashes, dash.Dashes], Shader=swatch, Thickness=Slider(1, range=0..20), Absolute=False)

crv_7 = Curve(python_4.cut_line)
previewlw_3 = CustomPreviewLineweights(Geometry=crv_7, Shader=ColourSwatch(SwatchColor=RGB(0, 31, 189)), Thickness=Slider(1, range=0..20), Absolute=False)
