# Grasshopper definition git_help.gh (Grasshopper 1.0.7)

python = GhPythonScript()  # -> path
# ---------- python: Python ----------
import os

def find_git_help_script():
    # Get the path to the GH file
    doc = ghenv.Component.OnPingDocument()
    file_path = doc.FilePath
    if not file_path:
        print "File not saved"
        return None

    current_dir = os.path.dirname(file_path)  # Current directory of the .gh file
    parent_dir = os.path.dirname(current_dir)  # One level higher

    py_dir = os.path.join(parent_dir, "Py")  # Expected Py folder
    target_file = os.path.join(py_dir, "git_help.py")

    if os.path.exists(target_file):
        print "✅ Found git_help.py:", target_file
        return target_file
    else:
        print "❌ The file git_help.py was not found in:", py_dir
        return None

path = find_git_help_script()
# ---------- end python ----------
file = ReadFile(File=python, PerLineParse=False)
python_2 = GhPythonScript(Code=file, OPEN_MAIN_BRANCH=Button(), OPEN_HELP_IN_GITHUB=Button(), OPEN_LOCAL_HELP=Button())  # -> Out, Md
panel = Panel(python_2.Md)
