# Grasshopper definition temp_01.gh (Grasshopper 1.0.7)

python = GhPythonScript(OPEN_MAIN_BRANCH=Button(), OPEN_HELP_IN_GITHUB=Button())  # -> out, a; inputs OPEN_MAIN_BRANCH: Boolean
# ---------- python: Python ----------
import System
import webbrowser
import clr
import os

REPO_URL = "https://github.com/Andrupavlov/GHDoc-temp"
SUBFOLDER_IN_REPO = "Doc"

def open_url_in_thread(url):
    def thread_func():
        webbrowser.open(url)
    t = System.Threading.Thread(System.Threading.ThreadStart(thread_func))
    t.IsBackground = True
    t.Start()

def get_gh_filename():
    doc = ghenv.Component.OnPingDocument()
    file_path = doc.FilePath
    if not file_path:
        print "File not saved"
        return None, None

    file_name = os.path.basename(file_path)
    name_without_ext = os.path.splitext(file_name)[0]
    folder = os.path.dirname(file_path)
    return name_without_ext, folder

def find_git_root(start_folder):
    current = start_folder
    while current and current != os.path.dirname(current):
        if os.path.isdir(os.path.join(current, ".git")):
            return current
        current = os.path.dirname(current)
    return None

def get_git_branch(git_root_folder):
    head_path = os.path.join(git_root_folder, ".git", "HEAD")
    if not os.path.exists(head_path):
        print ".git/HEAD does not exist"
        return None

    with open(head_path, "r") as f:
        content = f.read().strip()
        if content.startswith("ref: refs/heads/"):
            return content.replace("ref: refs/heads/", "")
        else:
            return None

def open_github_doc(base_repo_url, doc_subfolder="Doc"):
    file_name, file_folder = get_gh_filename()
    if not file_name or not file_folder:
        return

    git_root = find_git_root(file_folder)
    if not git_root:
        print "No .git found in directories above"
        return

    branch = get_git_branch(git_root)
    if not branch:
        return

    # Link to an .md file with the same name
    github_path = base_repo_url + "/blob/" + branch + "/" + doc_subfolder + "/" + file_name + ".md"

    # Open in browser in a separate thread
    def thread_func():
        webbrowser.open(github_path)

    t = System.Threading.Thread(System.Threading.ThreadStart(thread_func))
    t.IsBackground = True
    t.Start()

    return github_path


if OPEN_MAIN_BRANCH:
    open_url_in_thread(REPO_URL)

if OPEN_HELP_IN_GITHUB:
    open_github_doc(REPO_URL, doc_subfolder=SUBFOLDER_IN_REPO)
# ---------- end python ----------
python_2 = GhPythonScript(OPEN_MAIN_BRANCH=Button(), OPEN_HELP_IN_GITHUB=Button())  # -> out, a; inputs OPEN_MAIN_BRANCH: Boolean
# ---------- python_2: Python ----------
import System
import webbrowser
import clr
import os

clr.AddReference("System.Net")
import System.Net

REPO_URL = "https://github.com/Andrupavlov/GHDoc-temp"
RAW_URL = "https://raw.githubusercontent.com/Andrupavlov/GHDoc-temp"
SUBFOLDER_IN_REPO = "Doc"

def open_url_in_thread(url):
    def thread_func():
        webbrowser.open(url)
    t = System.Threading.Thread(System.Threading.ThreadStart(thread_func))
    t.IsBackground = True
    t.Start()

def get_gh_filename():
    doc = ghenv.Component.OnPingDocument()
    file_path = doc.FilePath
    if not file_path:
        print "File not saved"
        return None, None

    file_name = os.path.basename(file_path)
    name_without_ext = os.path.splitext(file_name)[0]
    folder = os.path.dirname(file_path)
    return name_without_ext, folder

def find_git_root(start_folder):
    current = start_folder
    while current and current != os.path.dirname(current):
        if os.path.isdir(os.path.join(current, ".git")):
            return current
        current = os.path.dirname(current)
    return None

def get_git_branch(git_root_folder):
    head_path = os.path.join(git_root_folder, ".git", "HEAD")
    if not os.path.exists(head_path):
        print ".git/HEAD does not exist"
        return None

    with open(head_path, "r") as f:
        content = f.read().strip()
        if content.startswith("ref: refs/heads/"):
            return content.replace("ref: refs/heads/", "")
        else:
            return None

def check_github_file_exists(branch, subfolder, filename_no_ext):
    raw_url = RAW_URL + "/" + branch + "/" + subfolder + "/" + filename_no_ext + ".md"
    try:
        req = System.Net.WebRequest.Create(raw_url)
        req.Method = "HEAD"
        resp = req.GetResponse()
        resp.Close()
        return True
    except System.Net.WebException as e:
        if e.Response:
            e.Response.Close()
        return False

def open_github_doc(base_repo_url, doc_subfolder="Doc"):
    file_name, file_folder = get_gh_filename()
    if not file_name or not file_folder:
        return

    git_root = find_git_root(file_folder)
    if not git_root:
        print "No .git found in directories above"
        return

    branch = get_git_branch(git_root)
    if not branch:
        return

    file_exists = check_github_file_exists(branch, doc_subfolder, file_name)
    if not file_exists:
        print "Markdown-файл для цього GH-файлу не існує на GitHub:"
        print "  " + file_name + ".md"
        return

    github_path = base_repo_url + "/blob/" + branch + "/" + doc_subfolder + "/" + file_name + ".md"

    def thread_func():
        webbrowser.open(github_path)

    t = System.Threading.Thread(System.Threading.ThreadStart(thread_func))
    t.IsBackground = True
    t.Start()

    return github_path

# Тригери (мають бути налаштовані як булеві input-и в GH)
if OPEN_MAIN_BRANCH:
    open_url_in_thread(REPO_URL)

if OPEN_HELP_IN_GITHUB:
    open_github_doc(REPO_URL, doc_subfolder=SUBFOLDER_IN_REPO)
# ---------- end python_2 ----------
python_3 = GhPythonScript(OPEN_MAIN_BRANCH=Button(), OPEN_HELP_IN_GITHUB=Button(), OPEN_LOCAL_HELP=Button())  # -> out; inputs OPEN_MAIN_BRANCH: Boolean
# ---------- python_3: Python ----------
import System
import webbrowser
import clr
import os

clr.AddReference("System.Net")
import System.Net

REPO_URL = "https://github.com/Andrupavlov/GHDoc-temp"
RAW_URL = "https://raw.githubusercontent.com/Andrupavlov/GHDoc-temp"
SUBFOLDER_IN_REPO = "Doc"

def open_url_in_thread(url):
    def thread_func():
        webbrowser.open(url)
    t = System.Threading.Thread(System.Threading.ThreadStart(thread_func))
    t.IsBackground = True
    t.Start()

def get_gh_filename():
    doc = ghenv.Component.OnPingDocument()
    file_path = doc.FilePath
    if not file_path:
        print "File not saved"
        return None, None

    file_name = os.path.basename(file_path)
    name_without_ext = os.path.splitext(file_name)[0]
    folder = os.path.dirname(file_path)
    return name_without_ext, folder

def find_git_root(start_folder):
    current = start_folder
    while current and current != os.path.dirname(current):
        if os.path.isdir(os.path.join(current, ".git")):
            return current
        current = os.path.dirname(current)
    return None

def get_git_branch(git_root_folder):
    head_path = os.path.join(git_root_folder, ".git", "HEAD")
    if not os.path.exists(head_path):
        print ".git/HEAD does not exist"
        return None

    with open(head_path, "r") as f:
        content = f.read().strip()
        if content.startswith("ref: refs/heads/"):
            return content.replace("ref: refs/heads/", "")
        else:
            return None

def check_github_file_exists(branch, subfolder, filename_no_ext):
    raw_url = RAW_URL + "/" + branch + "/" + subfolder + "/" + filename_no_ext + ".md"
    try:
        req = System.Net.WebRequest.Create(raw_url)
        req.Method = "HEAD"
        resp = req.GetResponse()
        resp.Close()
        return True
    except System.Net.WebException as e:
        if e.Response:
            e.Response.Close()
        return False

def create_local_md_file(git_root, subfolder, filename_no_ext):
    doc_dir = os.path.join(git_root, subfolder)
    if not os.path.exists(doc_dir):
        os.makedirs(doc_dir)

    md_path = os.path.join(doc_dir, filename_no_ext + ".md")
    if os.path.exists(md_path):
        print "Файл уже існує локально:", md_path
        return

    with open(md_path, "w") as f:
        f.write("# " + filename_no_ext + "\n\nДокументація для " + filename_no_ext + ".gh\n")
    print "✅ Створено локальний .md файл:", md_path
    print "→ Не забудь закомітити й запушити його до GitHub"

def open_github_doc(base_repo_url, doc_subfolder="Doc"):
    file_name, file_folder = get_gh_filename()
    if not file_name or not file_folder:
        return

    git_root = find_git_root(file_folder)
    if not git_root:
        print "No .git found in directories above"
        return

    branch = get_git_branch(git_root)
    if not branch:
        return

    file_exists = check_github_file_exists(branch, doc_subfolder, file_name)
    if not file_exists:
        print "❌ Markdown-файл не знайдено на GitHub. Створюю локально..."
        create_local_md_file(git_root, doc_subfolder, file_name)

    github_path = base_repo_url + "/blob/" + branch + "/" + doc_subfolder + "/" + file_name + ".md"
    open_url_in_thread(github_path)
    return github_path

def open_local_md_file(doc_subfolder="Doc"):
    file_name, file_folder = get_gh_filename()
    if not file_name or not file_folder:
        return

    git_root = find_git_root(file_folder)
    if not git_root:
        print "No .git found in directories above"
        return

    doc_dir = os.path.join(git_root, doc_subfolder)
    if not os.path.exists(doc_dir):
        os.makedirs(doc_dir)

    md_path = os.path.join(doc_dir, file_name + ".md")
    if not os.path.exists(md_path):
        with open(md_path, "w") as f:
            f.write("# " + file_name + "\n\nДокументація для " + file_name + ".gh\n")
        print "✅ Створено локальний .md файл:", md_path
        print "→ Не забудь закомітити його в git"

    # Відкрити у системному редакторі
    try:
        System.Diagnostics.Process.Start(md_path)
        print "📄 Відкрито локальний файл:", md_path
    except Exception as e:
        print "Не вдалося відкрити файл:", str(e)

# Тригери з Grasshopper
if OPEN_MAIN_BRANCH:
    open_url_in_thread(REPO_URL)

if OPEN_HELP_IN_GITHUB:
    open_github_doc(REPO_URL, doc_subfolder=SUBFOLDER_IN_REPO)

if OPEN_LOCAL_HELP:
    open_local_md_file(SUBFOLDER_IN_REPO)
# ---------- end python_3 ----------
panel = Panel(python.out)
panel_2 = Panel(python_3)
number_slider = Slider(100, range=0..100)
box = CenterBox(Base=PlaneXY(0, 0, 0), X=number_slider, Y=number_slider, Z=number_slider)
